# Grasshopper definition CaseStudy1.gh (Grasshopper 1.0.8)
# plug-ins: End Point Predictor, FEM-Design

sectiondatabase = SectionDatabase()  # -> SteelSection, ConcreteSection, TimberSection, HollowCoreSection, CustomSection
search_names = Python3Script(Sections=sectiondatabase.SteelSection, Search="HE-B")  # -> out, Matches; inputs Sections: list
# ---------- search_names: Python ----------
"""
Inputs:
    Sections: Liste med tekststrenger (f.eks. fra Panel)
    Search:   Tekst å søke etter (substring)
Outputs:
    Matches:  Alle entries som inneholder søketeksten
"""

# Håndter litt fleksibel input
matches = []

# Sørg for at vi har noe å søke etter
if Search is not None:
    search_str = str(Search).strip()
else:
    search_str = ""

if search_str and Sections:
    # Hvis Sections er én lang tekst, splitt til liste
    if isinstance(Sections, str):
        sections_list = Sections.splitlines()
    else:
        sections_list = list(Sections)

    # Case-insensitivt søk (IPE == ipe)
    search_lower = search_str.lower()
    for s in sections_list:
        if search_lower in str(s).lower():
            matches.append(s)

# Output til Grasshopper
Matches = matches
# ---------- end search_names ----------
panel = Panel("CHS298.5-10.0")
panel_2 = Panel("HE-A300")
panel_3 = Panel("IPE300")
panel_4 = Panel("U300")
section_getsectionbyname_index = SectionGetSectionByNameIndex(Sections=sectiondatabase.SteelSection, SectionNameIndex=search_names.Matches)
panel_5 = Panel("IPE")
list_item = ListItem(List=sectiondatabase.SteelSection, Index="310", Wrap=True)
section_byshape = SectionByShape(Sections=sectiondatabase.SteelSection, Family="LU")
panel_6 = Panel(list_item)
panel_7 = Panel(sectiondatabase.SteelSection)
section_deconstruct = SectionDeconstruct(Section=section_getsectionbyname_index)  # -> Guid, Name, flatten(Surfaces), SectionType, MaterialType, GroupName, TypeName, SizeName
scale = Scale(Geometry=section_deconstruct.Surfaces, Center=Point(0, 0, 0), Factor="1000")  # -> Geometry, Transform
rotate = Rotate(Geometry=scale.Geometry, Angle=degrees("90"), Plane=PlaneXY(0, 0, 0))  # -> Geometry, Transform
panel_8 = Panel(rotate.Geometry)
list_item_2 = ListItem(List=rotate.Geometry, Index="66", Wrap=True)
set_number_of_points_on_beam = Panel("1024")

# ----
# Adjsut W,H and L domain
L = Slider(3000, range=0..15000)
W = Slider(250, range=0..2000)
H = Slider(100, range=0..2000)

unit_z = UnitZ(Factor=L)

# ----
# Beam type 1: Butt
# dette er egt bakt inn i ny kode, men grunnet
# skjæringsakse osv er det lettest å bare bruke den.
rectangle = Rectangle(Plane=PlaneXY(0, 0, 0), XSize=H, YSize=W, Radius=0)  # -> Rectangle, Length
extrude = Extrude(Base=rectangle.Rectangle, Direction=unit_z)
cap_holes = CapHoles(Brep=extrude)  # -> flatten(Brep)
scale_2 = Panel("1")
centerplacing = Python3Script(B=cap_holes, s=scale_2)  # -> out, B_moved, T; inputs B: list of Brep, s: Double
# ---------- centerplacing: Python ----------
import Rhino.Geometry as rg

B_moved = []
T = []   # translasjonene (til origo)

for b in B:
    if not b:
        B_moved.append(None)
        T.append(None)
        continue

    # Finn senter (volumsenter)
    vmp = rg.VolumeMassProperties.Compute(b)
    if vmp:
        c = vmp.Centroid
    else:
        # fallback: bounding box-senter
        c = b.GetBoundingBox(True).Center

    # 1) Translasjonsvektor til origo
    vec = rg.Vector3d(-c.X, -c.Y, -c.Z)
    xform_move = rg.Transform.Translation(vec)
    b.Transform(xform_move)

    # 2) Skalering i Z-retning rundt origo
    # s = 1.0 -> ingen skalering
    if s is not None and s != 1.0:
        # Skaler i global Z, rundt (0,0,0)
        xform_scale = rg.Transform.Scale(rg.Plane.WorldXY, 1.0, 1.0, s)
        b.Transform(xform_scale)

    B_moved.append(b)
    T.append(vec)
# ---------- end centerplacing ----------
panel_9 = Panel(centerplacing.B_moved)

bounding_box = BoundingBox(Content=centerplacing.B_moved, Plane=PlaneXY(0, 0, 0))  # -> Box, Box_2
unit_z_2 = UnitZ(Factor=1)
line_sdl = LineSDL(Start="0,0,-9999", Direction=unit_z_2, Length="100000")
brep_line = BrepLine(Brep=bounding_box.Box, Line=line_sdl, LimitToFirst=False)  # -> Curves, Points
polyline = PolyLine(Vertices=brep_line.Points, Closed=False)
line = Line(polyline)
end_points = EndPoints(Curve=line)  # -> Start, End
vector_2pt = Vector2Pt(PointA=end_points.Start, PointB=end_points.End, Unitize=False)  # -> Vector, Length
unit_vector = UnitVector(Vector=vector_2pt.Vector)
panel_10 = Panel(unit_vector)
line_2 = Line(StartPoint=end_points.Start, EndPoint=end_points.End)
grader = Panel("""0
30
45
60
75
90""")
curve_middle = CurveMiddle(Curve=line_2)
rotate_3d_solids = Rotate3D(Geometry=centerplacing.B_moved, Angle=degrees(grader), Center=curve_middle, Axis="{1,0,0}")  # -> Geometry, Transform
rotate_3d_solids_2 = Rotate3D(Geometry=unit_vector, Angle=degrees(grader), Center=curve_middle, Axis="{1,0,0}")  # -> Geometry, Transform
grader_2 = Panel("""0
30
45
60
75
90""")
multiplication = Multiplication(A=grader_2, B="0")
rotate_3d_solids_3 = Rotate3D(Geometry=rotate_3d_solids.Geometry, Angle=degrees(multiplication), Center=curve_middle, Axis="{0,0,1}")  # -> Geometry, Transform
rotate_3d_solids_4 = Rotate3D(Geometry=rotate_3d_solids_2.Geometry, Angle=degrees(multiplication), Center=curve_middle, Axis="{0,0,1}")  # -> Geometry, Transform
mesh_brep = MeshBrep(
    Brep=rotate_3d_solids_3.Geometry,
    Settings={GridMaxCount=0, GridMinCount=16, JaggedSeams=False, MaxEdgeLength=0, MinEdgeLength=0.0001, MinTolerance=0, Refine=True, RefineAngle=0, RelativeTolerance=0.65, SimplePlanes=True, Tolerance=0})
# Make pointcloud
triangulate = Triangulate(Mesh=mesh_brep)  # -> Mesh, Count
panel_11 = Panel(rotate_3d_solids_4.Geometry)
fasit_vektor = Panel(rotate_3d_solids_4.Geometry)
mesh_to_pointcloud = Mesh_to_PointCloud(Meshes=triangulate.Mesh, NrPts=set_number_of_points_on_beam, Seed=-1)  # -> PtsPerFace, PointClouds, Locations, TotalArea
filepath = Filepath(text=["Enter filepath model", "pointnet_reg_best.pt"])
predict_axis_scaled_centered = PredictAxisScaledCentered(
    PointsTree=mesh_to_pointcloud.Locations,
    Breps=rotate_3d_solids_3.Geometry,
    Scale="0.4",
    ModelPath=filepath,
    ScriptPath="Enter filpath\Run_Trained_model.py",
    Run=Toggle(True))  # -> Center, Direction, Centroid_Used, Centroid_PC, Centroid_Brep, Centroid_Delta, Log
unit_vector_2 = UnitVector(Vector=flatten(predict_axis_scaled_centered.Direction))
predikert_vektor = Panel(unit_vector_2)
flip_vektor = Python3Script(pred=predikert_vektor, fasit=fasit_vektor, tol=Slider(4.046, range=0..10))  # -> out, s; inputs pred: list of Vector3d, fasit: list of Vector3d, tol: Double
# ---------- flip_vektor: Python ----------
import Rhino

# pred: list of Vector3d
# fasit: list of Vector3d
# tol: float, angle tolerance in degrees

def classify(v1, v2, tol_deg):
    # Håndter null-vektorer
    if v1.IsZero or v2.IsZero:
        return 1  # eller -1, spiller egentlig liten rolle her

    # Konverter toleranse til radianer (Rhino bruker radianer)
    tol_rad = Rhino.RhinoMath.ToRadians(tol_deg)

    # IsParallelTo returnerer:
    #  1  = parallell (samme retning)
    # -1  = antiparallell (motsatt retning)
    #  0  = ikke innenfor toleranse
    rel = v1.IsParallelTo(v2, tol_rad)

    if rel == 1:
        return 1
    elif rel == -1:
        return -1
    else:
        # Fall-back: bruk dot-produktet til å bestemme fortegn
        dp = v1 * v2  # overloaded operator
        return 1 if dp >= 0 else -1

# Sørg for at listene har samme lengde
n = min(len(pred), len(fasit))
s = []

for i in range(n):
    v1 = pred[i]
    v2 = fasit[i]
    s.append(classify(v1, v2, tol))
# ---------- end flip_vektor ----------
multiplication_2 = Multiplication(A=unit_vector_2, B=flip_vektor.s)
angle = Angle(VectorA=fasit_vektor, VectorB=multiplication_2)  # -> Angle, Reflex
degrees = Degrees(Radians=angle.Angle)
feil_i_grader = Panel(degrees)
analytical_lines_localbbox = Analytical_LinesLocalBBox(
    Center=predict_axis_scaled_centered.Center,
    Direction=predict_axis_scaled_centered.Direction,
    Geometry=rotate_3d_solids_3.Geometry,
    Extend=Slider(0, range=-100..1000))  # -> AxisLine, P1, P2, BBoxLocal, BBoxCorners, Log
number_slider = Slider(4, range=0..10)
panel_12 = Panel("""{0,0,0}
{0,1000,0}
{0,0,-1000}
{0,1000,-1000}
{0,0,-2000}
{0,1000,-2000}""")
panel_13 = Panel("""{0,0,0}
{0,1000,0}
{0,2000,0}
{0,0,-1000}
{0,1000,-1000}
{0,2000,-1000}""")
panel_14 = Panel("""{0,0,0}
{0,0,0}
{0,0,0}
{0,0,0}
{0,0,0}
{0,0,0}""")

# ----
# Local boundingbox
panel_15 = Panel("30")
sphere = Sphere(Base=flatten(analytical_lines_localbbox.P1), Radius=panel_15)
sphere_2 = Sphere(Base=flatten(analytical_lines_localbbox.P2), Radius=panel_15)
line_3 = Line(StartPoint=flatten(analytical_lines_localbbox.P1), EndPoint=flatten(analytical_lines_localbbox.P2))  # -> flatten(Line)
display = Display(geometry=flatten(line_3), point_a=panel_14, point_b=panel_12, B=number_slider)
display_2 = Display(geometry=flatten(sphere), point_a=panel_14, point_b=panel_12, B=number_slider)
display_3 = Display(geometry=flatten(sphere_2), point_a=panel_14, point_b=panel_12, B=number_slider)

construct_point = ConstructPoint(XCoordinate=0, YCoordinate=0, ZCoordinate=0)

# ----
# Pointcloud display
display_4 = Display(geometry=mesh_to_pointcloud.PointClouds, point_a=panel_14, point_b=panel_12, B=number_slider)
custom_preview = CustomPreview(Geometry=display_4, Material=ColourSwatch(SwatchColor=RGB(0, 242, 255)))

unit_y = UnitY(Factor=Slider(754, range=-3000..3000))
unit_z_3 = UnitZ(Factor=Slider(305, range=-3000..3000))
display_5 = Display(geometry=flatten(rotate_3d_solids_3.Geometry), point_a=panel_14, point_b=panel_12, B=number_slider)

# ----
# Predicted axis
number_slider_2 = Slider(1500, range=0..6000)
line_sdl_2 = LineSDL(Start=construct_point, Direction=multiplication_2, Length=number_slider_2)
display_6 = Display(geometry=line_sdl_2, point_a=panel_14, point_b=panel_12, B=number_slider)
colour_swatch = ColourSwatch(SwatchColor=RGB(255, 3, 3))
pipe = Pipe(Curve=display_6, Radius="10", Caps=0, FitRail=False)  # -> flatten(Pipe)
custom_preview_2 = CustomPreview(Geometry=pipe, Material=colour_swatch)

# ----
# Predicted point
point = Point(flatten(predict_axis_scaled_centered.Center))
display_7 = Display(geometry=point, point_a=panel_14, point_b=panel_12, B=number_slider)
sphere_3 = Sphere(Base=display_7, Radius="70")
custom_preview_3 = CustomPreview(Geometry=sphere_3, Material=colour_swatch)

# ----
# Fasit point
volume = Volume(Geometry=rotate_3d_solids_3.Geometry)  # -> Volume, Centroid
display_8 = Display(geometry=volume.Centroid, point_a=panel_14, point_b=panel_12, B=number_slider)
sphere_4 = Sphere(Base=display_8, Radius="70")
colour_swatch_2 = ColourSwatch(SwatchColor=RGB(7, 3, 255))
custom_preview_4 = CustomPreview(Geometry=sphere_4, Material=colour_swatch_2)

# ----
# Fasit axis
number_slider_3 = Slider(1500, range=0..6000)
construct_point_2 = ConstructPoint(XCoordinate=0, YCoordinate=0, ZCoordinate=0)
line_sdl_3 = LineSDL(Start=construct_point_2, Direction=fasit_vektor, Length=number_slider_3)
display_9 = Display(geometry=line_sdl_3, point_a=panel_14, point_b=panel_12, B=number_slider)
pipe_2 = Pipe(Curve=display_9, Radius="4", Caps=0, FitRail=False)  # -> flatten(Pipe)
custom_preview_5 = CustomPreview(Geometry=pipe_2, Material=colour_swatch_2)

distance = Distance(PointA=volume.Centroid, PointB=point)

# ----
# Regne avstnad mellom x og  y koordinat da det er det som har noe å si når vi bruker bounding box.
deconstruct = Deconstruct(Point=flatten(point))  # -> XComponent, YComponent, ZComponent
deconstruct_2 = Deconstruct(Point=flatten(volume.Centroid))  # -> XComponent, YComponent, ZComponent
absolute = Absolute(Value=deconstruct.ZComponent)
absolute_2 = Absolute(Value=deconstruct.YComponent)
absolute_3 = Absolute(Value=deconstruct.XComponent)
absolute_4 = Absolute(Value=deconstruct_2.ZComponent)
absolute_5 = Absolute(Value=deconstruct_2.YComponent)
absolute_6 = Absolute(Value=deconstruct_2.XComponent)
subtraction = Subtraction(A=absolute_6, B=absolute_3)
subtraction_2 = Subtraction(A=absolute_5, B=absolute_2)
subtraction_3 = Subtraction(A=absolute_4, B=absolute)
regne_avstand_i_x_og_y = Python3Script(x=subtraction, y=subtraction_2, z=subtraction_3)  # -> out, dist; inputs x: list of Double, y: list of Double, z: list of Double
# ---------- regne_avstand_i_x_og_y: Python ----------
import math

def dist(x, y):
    return [math.sqrt(xi**2 + yi**2) for xi, yi in zip(x, y)]
dist = dist(x, y)
# ---------- end regne_avstand_i_x_og_y ----------
panel_16 = Panel(regne_avstand_i_x_og_y.dist)

unit_y_2 = UnitY(Factor=Slider(-31, range=-300..300))
unit_z_4 = UnitZ(Factor=Slider(85, range=0..200))
panel_17 = Panel("100")
annotation_text_settings = AnnotationTextSettings(Font="Latin Modern Roman", TextHeight="2.5", TextGap="0", MaskColour=RGB(0, 0, 0))  # -> TextSettings, Font, TextHeight, TextGap, Mask, MaskColour, MaskMargins, MaskFrame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
annotation_style = AnnotationStyle(Name="LaTeX_12pt", TextSettings=annotation_text_settings.TextSettings)  # -> AnnotationStyle, Name, ModelScale, TextSettings, DimensionSettings, ArrowSettings, UnitsSettings, LeaderSettings, ToleranceSettings
annotation_text_settings_2 = AnnotationTextSettings(Font="Latin Modern Roman", TextHeight="2.5", TextGap="0", MaskColour=RGB(0, 0, 0))  # -> TextSettings, Font, TextHeight, TextGap, Mask, MaskColour, MaskMargins, MaskFrame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
annotation_text_settings_3 = AnnotationTextSettings(Font="Latin Modern Roman", TextHeight="2.5", TextGap="0", MaskColour=RGB(0, 0, 0))  # -> TextSettings, Font, TextHeight, TextGap, Mask, MaskColour, MaskMargins, MaskFrame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
annotation_text_settings_4 = AnnotationTextSettings(Font="Latin Modern Roman", TextHeight="2.5", TextGap="0", MaskColour=RGB(0, 0, 0))  # -> TextSettings, Font, TextHeight, TextGap, Mask, MaskColour, MaskMargins, MaskFrame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
annotation_style_2 = AnnotationStyle(Name="LaTeX_12pt", TextSettings=annotation_text_settings_2.TextSettings)  # -> AnnotationStyle, Name, ModelScale, TextSettings, DimensionSettings, ArrowSettings, UnitsSettings, LeaderSettings, ToleranceSettings
annotation_style_3 = AnnotationStyle(Name="LaTeX_12pt", TextSettings=annotation_text_settings_3.TextSettings)  # -> AnnotationStyle, Name, ModelScale, TextSettings, DimensionSettings, ArrowSettings, UnitsSettings, LeaderSettings, ToleranceSettings
annotation_style_4 = AnnotationStyle(Name="LaTeX_12pt", TextSettings=annotation_text_settings_4.TextSettings)  # -> AnnotationStyle, Name, ModelScale, TextSettings, DimensionSettings, ArrowSettings, UnitsSettings, LeaderSettings, ToleranceSettings

# ----
# Axis
number_slider_4 = Slider(1600, range=0..10000)
unit_x = UnitX(Factor=1)
unit_y_3 = UnitY(Factor=1)
unit_z_5 = UnitZ(Factor=1)
line_sdl_4 = LineSDL(Start=construct_point_2, Direction=unit_z_5, Length=number_slider_4)
line_sdl_5 = LineSDL(Start=construct_point_2, Direction=unit_y_3, Length=number_slider_4)
line_sdl_6 = LineSDL(Start=construct_point_2, Direction=unit_x, Length=number_slider_4)
display_10 = Display(geometry=line_sdl_4, point_a=panel_14, point_b=panel_12, B=number_slider)
display_11 = Display(geometry=line_sdl_6, point_a=panel_14, point_b=panel_12, B=number_slider)
display_12 = Display(geometry=line_sdl_5, point_a=panel_14, point_b=panel_12, B=number_slider)
panel_21 = Panel("""4
5""")
panel_22 = Panel("""2
3""")
panel_23 = Panel("""0
1""")
unit_z_6 = UnitZ(Factor=Slider(-1890, range=-3000..3000))
unit_z_7 = UnitZ(Factor=Slider(-2257, range=-3000..3000))
unit_z_8 = UnitZ(Factor=Slider(-2512, range=-3000..3000))
end_points_2 = EndPoints(Curve=display_11)  # -> Start, End
end_points_3 = EndPoints(Curve=display_12)  # -> Start, End
end_points_4 = EndPoints(Curve=display_10)  # -> Start, End
list_item_3 = ListItem(List=end_points_4.End, Index=panel_21, Wrap=True)
list_item_4 = ListItem(List=end_points_4.End, Index=panel_22, Wrap=True)
list_item_5 = ListItem(List=end_points_4.End, Index=panel_23, Wrap=True)
custom_preview_6 = CustomPreview(Geometry=[display_10, display_12, display_11], Material=ColourSwatch(SwatchColor=RGB(0, 0, 0)))
move = Move(Geometry=list_item_3, Motion=unit_z_6)  # -> Geometry, Transform
move_2 = Move(Geometry=list_item_4, Motion=unit_z_7)  # -> Geometry, Transform
move_3 = Move(Geometry=list_item_5, Motion=unit_z_8)  # -> Geometry, Transform
unit_x_2 = UnitX(Factor=Slider(140, range=0..200))
merge = Merge(Data1=move_3.Geometry, Data2=move_2.Geometry, Data3=move.Geometry)
unit_z_9 = UnitZ(Factor=Slider(413, range=-500..500))
unit_y_4 = UnitY(Factor=Slider(140, range=0..200))
panel_24 = Panel(merge)
move_4 = Move(Geometry=end_points_2.End, Motion=unit_x_2)  # -> Geometry, Transform
concatenate = Concatenate(Fragment_A="Rotation: ", Fragment_B=grader, A="°")
text_tag = TextTag(Location=merge, Text=concatenate, Colour=RGB(0, 0, 0))

move_5 = Move(Geometry=end_points_4.End, Motion=unit_y_2)  # -> Geometry, Transform
move_6 = Move(Geometry=end_points_3.End, Motion=unit_z_4)  # -> Geometry, Transform

move_7 = Move(Geometry=move_6.Geometry, Motion=unit_y_4)  # -> Geometry, Transform
move_8 = Move(Geometry=move_5.Geometry, Motion=unit_z_9)  # -> Geometry, Transform
text_tag_2 = TextTag(Location=move_8.Geometry, Text="Z", Colour=RGB(0, 0, 0))
text_tag_3 = TextTag(Location=move_7.Geometry, Text="Y", Colour=RGB(0, 0, 0))

annotation_text_settings_5 = AnnotationTextSettings(Font="Latin Modern Roman", TextHeight="2.5", TextGap="0", MaskColour=RGB(0, 0, 0))  # -> TextSettings, Font, TextHeight, TextGap, Mask, MaskColour, MaskMargins, MaskFrame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
annotation_style_5 = AnnotationStyle(Name="LaTeX_12pt", TextSettings=annotation_text_settings_5.TextSettings)  # -> AnnotationStyle, Name, ModelScale, TextSettings, DimensionSettings, ArrowSettings, UnitsSettings, LeaderSettings, ToleranceSettings
plane_frome_kameraview = PlaneFromeKameraview(origin=move_4.Geometry)
plane_frome_kameraview_2 = PlaneFromeKameraview(origin=move_7.Geometry)
plane_frome_kameraview_3 = PlaneFromeKameraview(origin=move_8.Geometry)
plane_frome_kameraview_4 = PlaneFromeKameraview(origin=merge)
text_entity = TextEntity(Plane=plane_frome_kameraview, Text="X", Style=annotation_style_5.AnnotationStyle)  # -> TextEntity, Plane, Text, Style
text_entity_2 = TextEntity(Plane=plane_frome_kameraview_3, Text="Z", Style=annotation_style_2.AnnotationStyle)  # -> TextEntity, Plane, Text, Style
text_entity_3 = TextEntity(Plane=plane_frome_kameraview_2, Text="Y", Style=annotation_style_3.AnnotationStyle)  # -> TextEntity, Plane, Text, Style
text_entity_4 = TextEntity(Plane=plane_frome_kameraview_4, Text=concatenate, Style=annotation_style_4.AnnotationStyle)  # -> TextEntity, Plane, Text, Style

# ----
# Text for error
end_points_5 = EndPoints(Curve=line_sdl_3)  # -> Start, End
number_slider_5 = Slider(4, range=0..10)
display_13 = Display(geometry=end_points_5.Start, point_a=panel_14, point_b=panel_12, B=number_slider)
rund = Python3Script(x=degrees, decimals="3")  # -> out, a; inputs x: list of Double, decimals: Int32
# ---------- rund: Python ----------
# x: number or list
# decimals: integer

fmt = "{:." + str(decimals) + "f}"

if isinstance(x, (list, tuple)):
    a = [fmt.format(v) for v in x]
else:
    a = fmt.format(x)
# ---------- end rund ----------
concatenate_2 = Concatenate(Fragment_A="Error: ", Fragment_B=rund.a, A="°")

point_2 = Point(end_points_5.Start)
move_9 = Move(Geometry=display_13, Motion=unit_y)  # -> Geometry, Transform
move_10 = Move(Geometry=move_9.Geometry, Motion=unit_z_3)  # -> Geometry, Transform

text_tag_4 = TextTag(Location=move_10.Geometry, Text=concatenate_2, Colour=RGB(0, 0, 0))

plane_frome_kameraview_5 = PlaneFromeKameraview(origin=move_10.Geometry)
text_entity_5 = TextEntity(Plane=plane_frome_kameraview_5, Text=concatenate_2, Style=annotation_style.AnnotationStyle)  # -> TextEntity, Plane, Text, Style

# ==== cluster Filepath
text = ClusterInput()
text_join = TextJoin(Text=text, Join="\")
result = ClusterOutput(text_join)

# ==== cluster Display
point_a = ClusterInput()
point_b = ClusterInput()
vector_2pt = Vector2Pt(PointA=point_a, PointB=point_b, Unitize=False)  # -> Vector, Length
B = ClusterInput()
multiplication = Multiplication(A=vector_2pt.Vector, B=B)
geometry = ClusterInput()
move = Move(Geometry=geometry, Motion=multiplication)  # -> Geometry, Transform
geometry_2 = ClusterOutput(move.Geometry)

# ==== cluster PlaneFromeKameraview
unit_z = UnitZ(Factor=1)
camera_view = Python3Script()  # -> out, N
# ---------- camera_view: Python ----------
import Rhino

view = Rhino.RhinoDoc.ActiveDoc.Views.ActiveView
cam = view.ActiveViewport.CameraDirection


N = -cam
# ---------- end camera_view ----------
cross_product = CrossProduct(VectorA=unit_z, VectorB=camera_view.N, Unitize=False)  # -> Vector, Length
cross_product_2 = CrossProduct(VectorA=camera_view.N, VectorB=cross_product.Vector, Unitize=False)  # -> Vector, Length
origin = ClusterInput()
construct_plane = ConstructPlane(Origin=origin, XAxis=cross_product.Vector, YAxis=cross_product_2.Vector)
plane = ClusterOutput(construct_plane)
