# Grasshopper definition CaseStudy3 rotate 3D profiles.gh (Grasshopper 1.0.8)
# plug-ins: Analytical_model_fast, End Point Predictor, FEM-Design

panel = Panel("HE-B")
sectiondatabase = SectionDatabase()  # -> SteelSection, ConcreteSection, TimberSection, HollowCoreSection, CustomSection
search_names = Python3Script(Sections=sectiondatabase.SteelSection, Search="LU")  # -> out, Matches; inputs Sections: list
# ---------- search_names: Python ----------
"""
Inputs:
    Sections: Liste med tekststrenger (f.eks. fra Panel)
    Search:   Tekst å søke etter (substring)
Outputs:
    Matches:  Alle entries som inneholder søketeksten
"""

# Håndter litt fleksibel input
matches = []

# Sørg for at vi har noe å søke etter
if Search is not None:
    search_str = str(Search).strip()
else:
    search_str = ""

if search_str and Sections:
    # Hvis Sections er én lang tekst, splitt til liste
    if isinstance(Sections, str):
        sections_list = Sections.splitlines()
    else:
        sections_list = list(Sections)

    # Case-insensitivt søk (IPE == ipe)
    search_lower = search_str.lower()
    for s in sections_list:
        if search_lower in str(s).lower():
            matches.append(s)

# Output til Grasshopper
Matches = matches
# ---------- end search_names ----------
merge = Merge(Data1="CHS298.5-10.0", Data2="HE-B400", Data3="IPE300", Data4="U300", Data5="LU, 250*90*14", Data6="HE-A300")
section_getsectionbyname_index = SectionGetSectionByNameIndex(Sections=sectiondatabase.SteelSection, SectionNameIndex=merge)
list_item = ListItem(List=sectiondatabase.SteelSection, Index="310", Wrap=True)
section_byshape = SectionByShape(Sections=sectiondatabase.SteelSection, Family="LU")
panel_2 = Panel(list_item)
panel_3 = Panel(sectiondatabase.SteelSection)
section_deconstruct = SectionDeconstruct(Section=section_getsectionbyname_index)  # -> Guid, Name, flatten(Surfaces), SectionType, MaterialType, GroupName, TypeName, SizeName
scale = Scale(Geometry=section_deconstruct.Surfaces, Center=Point(0, 0, 0), Factor="1000")  # -> Geometry, Transform
panel_4 = Panel(scale.Geometry)
rotate = Rotate(Geometry=scale.Geometry, Angle=degrees("90"), Plane=PlaneXY(0, 0, 0))  # -> Geometry, Transform
unit_y = UnitY(Factor=1)
rotate_3d = Rotate3D(Geometry=rotate.Geometry, Angle=degrees("90"), Center=Point(0, 0, 0), Axis=unit_y)  # -> Geometry, Transform
set_number_of_points_on_beam = Panel("1024")

# ----
# Adjsut W,H and L domain
L = Slider(3000, range=0..15000)
W = Slider(250, range=0..2000)
H = Slider(100, range=0..2000)

unit_z = UnitZ(Factor=L)

# ----
# Beam type 1: Butt
# dette er egt bakt inn i ny kode, men grunnet
# skjæringsakse osv er det lettest å bare bruke den.
rectangle = Rectangle(Plane=PlaneXY(0, 0, 0), XSize=H, YSize=W, Radius=0)  # -> Rectangle, Length
extrude = Extrude(Base=scale.Geometry, Direction=unit_z)
cap_holes = CapHoles(Brep=extrude)  # -> flatten(Brep)
scale_2 = Panel("1")
centerplacing = Python3Script(B=cap_holes, s=scale_2)  # -> out, B_moved, T; inputs B: list of Brep, s: Double
# ---------- centerplacing: Python ----------
import Rhino.Geometry as rg

B_moved = []
T = []   # translasjonene (til origo)

for b in B:
    if not b:
        B_moved.append(None)
        T.append(None)
        continue

    # Finn senter (volumsenter)
    vmp = rg.VolumeMassProperties.Compute(b)
    if vmp:
        c = vmp.Centroid
    else:
        # fallback: bounding box-senter
        c = b.GetBoundingBox(True).Center

    # 1) Translasjonsvektor til origo
    vec = rg.Vector3d(-c.X, -c.Y, -c.Z)
    xform_move = rg.Transform.Translation(vec)
    b.Transform(xform_move)

    # 2) Skalering i Z-retning rundt origo
    # s = 1.0 -> ingen skalering
    if s is not None and s != 1.0:
        # Skaler i global Z, rundt (0,0,0)
        xform_scale = rg.Transform.Scale(rg.Plane.WorldXY, 1.0, 1.0, s)
        b.Transform(xform_scale)

    B_moved.append(b)
    T.append(vec)
# ---------- end centerplacing ----------
panel_5 = Panel(centerplacing.B_moved)

bounding_box = BoundingBox(Content=centerplacing.B_moved, Plane=PlaneXY(0, 0, 0))  # -> Box, Box_2
unit_z_2 = UnitZ(Factor=1)
line_sdl = LineSDL(Start="0,0,-9999", Direction=unit_z_2, Length="100000")
brep_line = BrepLine(Brep=bounding_box.Box, Line=line_sdl, LimitToFirst=False)  # -> Curves, Points
polyline = PolyLine(Vertices=brep_line.Points, Closed=False)
line = Line(polyline)
end_points = EndPoints(Curve=line)  # -> Start, End
vector_2pt = Vector2Pt(PointA=end_points.Start, PointB=end_points.End, Unitize=False)  # -> Vector, Length
unit_vector = UnitVector(Vector=vector_2pt.Vector)  # -> flatten(Vector)
panel_6 = Panel(unit_vector)
line_2 = Line(StartPoint=end_points.Start, EndPoint=end_points.End)
curve_middle = CurveMiddle(Curve=line_2)
list_item_2 = ListItem(List=flatten(curve_middle), Index=0, Wrap=True)
area = Area(Geometry=scale.Geometry)  # -> Area, Centroid
list_item_3 = ListItem(List=centerplacing.B_moved, Index="1", Wrap=True)
list_item_4 = ListItem(List=unit_vector, Index="1", Wrap=True)
list_item_5 = ListItem(List=centerplacing.B_moved, Index="2", Wrap=True)
list_item_6 = ListItem(List=unit_vector, Index="2", Wrap=True)
list_item_7 = ListItem(List=centerplacing.B_moved, Index="0", Wrap=True)
list_item_8 = ListItem(List=unit_vector, Index="0", Wrap=True)
list_item_9 = ListItem(List=centerplacing.B_moved, Index="3", Wrap=True)
list_item_10 = ListItem(List=unit_vector, Index="3", Wrap=True)
list_item_11 = ListItem(List=centerplacing.B_moved, Index="5", Wrap=True)
list_item_12 = ListItem(List=centerplacing.B_moved, Index="4", Wrap=True)
list_item_13 = ListItem(List=unit_vector, Index="5", Wrap=True)
list_item_14 = ListItem(List=unit_vector, Index="4", Wrap=True)
list_length = ListLength(List=area.Centroid)
series = Series(Start="0", Step="0", Count=list_length)
series_2 = Series(Start="1", Step="0", Count=list_length)
number_slider = Slider(0.7, range=0..5)
panel_7 = Panel("""{0,0,0}
{0,0,0}
{0,0,0}
{0,0,0}
{0,0,0}
{0,0,0}""")
panel_8 = Panel("""{0,0,0}
{1000,0,0}
{0,-1000,0}
{1000,-1000,0}
{0,-2000,0}
{1000,-2000,0}""")
construct_point = ConstructPoint(XCoordinate=series, YCoordinate=series, ZCoordinate=series)
construct_point_2 = ConstructPoint(XCoordinate=series_2, YCoordinate=series_2, ZCoordinate=series_2)
grader = Panel("30")
grader_2 = Panel("45")
grader_3 = Panel("60")
grader_4 = Panel("75")
grader_5 = Panel("90")
display = Display(geometry=centerplacing.B_moved, point_a=panel_7, point_b=panel_8, B=number_slider)
vector_xyz = VectorXYZ(XComponent=series, YComponent=series, ZComponent=series_2)  # -> Vector, Length
display_2 = Display(geometry=construct_point, point_a=panel_7, point_b=panel_8, B=number_slider)
grader_6 = Panel("30")
rotate_3d_solids = Rotate3D(Geometry=list_item_4, Angle=degrees(grader), Center=list_item_2, Axis="{1,0,0}")  # -> Geometry, Transform
rotate_3d_solids_2 = Rotate3D(Geometry=list_item_3, Angle=degrees(grader), Center=list_item_2, Axis="{1,0,0}")  # -> Geometry, Transform
rotate_3d_solids_3 = Rotate3D(Geometry=list_item_6, Angle=degrees(grader_2), Center=list_item_2, Axis="{1,0,0}")  # -> Geometry, Transform
unit_vector_2 = UnitVector(Vector=vector_xyz.Vector)
rotate_3d_solids_4 = Rotate3D(Geometry=list_item_5, Angle=degrees(grader_2), Center=list_item_2, Axis="{1,0,0}")  # -> Geometry, Transform
rotate_3d_solids_5 = Rotate3D(Geometry=list_item_10, Angle=degrees(grader_3), Center=list_item_2, Axis="{1,0,0}")  # -> Geometry, Transform
rotate_3d_solids_6 = Rotate3D(Geometry=list_item_9, Angle=degrees(grader_3), Center=list_item_2, Axis="{1,0,0}")  # -> Geometry, Transform
grader_7 = Panel("60")
rotate_3d_solids_7 = Rotate3D(Geometry=list_item_13, Angle=degrees(grader_5), Center=list_item_2, Axis="{1,0,0}")  # -> Geometry, Transform
rotate_3d_solids_8 = Rotate3D(Geometry=list_item_14, Angle=degrees(grader_4), Center=list_item_2, Axis="{1,0,0}")  # -> Geometry, Transform
rotate_3d_solids_9 = Rotate3D(Geometry=list_item_11, Angle=degrees(grader_5), Center=list_item_2, Axis="{1,0,0}")  # -> Geometry, Transform
rotate_3d_solids_10 = Rotate3D(Geometry=list_item_12, Angle=degrees(grader_4), Center=list_item_2, Axis="{1,0,0}")  # -> Geometry, Transform
grader_8 = Panel("45")
multiplication = Multiplication(A=grader_6, B="1")
multiplication_2 = Multiplication(A=grader_8, B="1")
multiplication_3 = Multiplication(A=grader_7, B="1")
grader_9 = Panel("75")
grader_10 = Panel("90")
custom_preview = CustomPreview(Geometry=display, Material=ColourSwatch(SwatchColor=RGB(76, 76, 76)))
multiplication_4 = Multiplication(A=grader_10, B="1")
multiplication_5 = Multiplication(A=grader_9, B="1")
rotate_3d_solids_11 = Rotate3D(Geometry=rotate_3d_solids_2.Geometry, Angle=degrees(multiplication), Center=list_item_2, Axis="{0,0,1}")  # -> Geometry, Transform
rotate_3d_solids_12 = Rotate3D(Geometry=rotate_3d_solids.Geometry, Angle=degrees(multiplication), Center=list_item_2, Axis="{0,0,1}")  # -> Geometry, Transform
rotate_3d_solids_13 = Rotate3D(Geometry=rotate_3d_solids_4.Geometry, Angle=degrees(multiplication_2), Center=list_item_2, Axis="{0,0,1}")  # -> Geometry, Transform
rotate_3d_solids_14 = Rotate3D(Geometry=rotate_3d_solids_3.Geometry, Angle=degrees(multiplication_2), Center=list_item_2, Axis="{0,0,1}")  # -> Geometry, Transform
rotate_3d_solids_15 = Rotate3D(Geometry=rotate_3d_solids_6.Geometry, Angle=degrees(multiplication_3), Center=list_item_2, Axis="{0,0,1}")  # -> Geometry, Transform
rotate_3d_solids_16 = Rotate3D(Geometry=rotate_3d_solids_5.Geometry, Angle=degrees(multiplication_3), Center=list_item_2, Axis="{0,0,1}")  # -> Geometry, Transform
rotate_3d_solids_17 = Rotate3D(Geometry=rotate_3d_solids_9.Geometry, Angle=degrees(multiplication_4), Center=list_item_2, Axis="{0,0,1}")  # -> Geometry, Transform
rotate_3d_solids_18 = Rotate3D(Geometry=rotate_3d_solids_10.Geometry, Angle=degrees(multiplication_5), Center=list_item_2, Axis="{0,0,1}")  # -> Geometry, Transform
rotate_3d_solids_19 = Rotate3D(Geometry=rotate_3d_solids_7.Geometry, Angle=degrees(multiplication_4), Center=list_item_2, Axis="{0,0,1}")  # -> Geometry, Transform
rotate_3d_solids_20 = Rotate3D(Geometry=rotate_3d_solids_8.Geometry, Angle=degrees(multiplication_5), Center=list_item_2, Axis="{0,0,1}")  # -> Geometry, Transform
mesh_brep = MeshBrep(
    Brep=display,
    Settings={GridMaxCount=0, GridMinCount=16, JaggedSeams=False, MaxEdgeLength=0, MinEdgeLength=0.0001, MinTolerance=0, Refine=True, RefineAngle=0, RelativeTolerance=0.65, SimplePlanes=True, Tolerance=0})
# Make pointcloud
triangulate = Triangulate(Mesh=mesh_brep)  # -> Mesh, Count
mesh_to_pointcloud = Mesh_to_PointCloud(Meshes=triangulate.Mesh, NrPts=set_number_of_points_on_beam, Seed=-1)  # -> PtsPerFace, PointClouds, Locations, TotalArea
merge_2 = Merge(
    Data1=list_item_8,
    Data2=rotate_3d_solids_12.Geometry,
    Data3=rotate_3d_solids_14.Geometry,
    Data4=rotate_3d_solids_16.Geometry,
    Data5=rotate_3d_solids_20.Geometry,
    Data6=rotate_3d_solids_19.Geometry)
panel_9 = Panel(merge_2)
merge_3 = Merge(
    Data1=list_item_7,
    Data2=rotate_3d_solids_11.Geometry,
    Data3=rotate_3d_solids_13.Geometry,
    Data4=rotate_3d_solids_15.Geometry,
    Data5=rotate_3d_solids_18.Geometry,
    Data6=rotate_3d_solids_17.Geometry)
multiplication_6 = Multiplication(A=L, B="0.5")
filepath = Filepath(text=["Enter filepath model", "pointnet_reg_best.pt"])
unit_z_3 = UnitZ(Factor=multiplication_6)
move = Move(Geometry=display_2, Motion=unit_z_3)  # -> Geometry, Transform
predict_axis_scaled_centered = PredictAxisScaledCentered(
    PointsTree=mesh_to_pointcloud.Locations,
    Breps=display,
    Scale="0.4",
    ModelPath=filepath,
    ScriptPath="Enter filpath\Run_Trained_model.py",
    Run=Toggle(True))  # -> Center, Direction, Centroid_Used, Centroid_PC, Centroid_Brep, Centroid_Delta, Log
panel_10 = Panel(predict_axis_scaled_centered.Centroid_Delta)
number_slider_2 = Slider(30, range=0..50)
make_analytical_lines_localbbox = Make_analytical_Lines_LocalBBox(
    Center=predict_axis_scaled_centered.Center,
    Direction=predict_axis_scaled_centered.Direction,
    Geometry=display,
    Extend=Slider(0, range=-100..1000))  # -> AxisLine, P1, P2, BBoxLocal, BBoxCorners, Log
point = Point(flatten(predict_axis_scaled_centered.Centroid_Brep))
sphere = Sphere(Base=flatten(predict_axis_scaled_centered.Center), Radius=number_slider_2)
annotation_text_settings = AnnotationTextSettings(Font="Times New Roman", TextHeight="130", TextGap="0", MaskColour=RGB(0, 0, 0))  # -> TextSettings, Font, TextHeight, TextGap, Mask, MaskColour, MaskMargins, MaskFrame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
sphere_2 = Sphere(Base=point, Radius=number_slider_2)
unit_y_2 = UnitY(Factor=Slider(-247, range=-1000..1000))
unit_z_4 = UnitZ(Factor=Slider(1500, range=0..2000))
annotation_text_settings_2 = AnnotationTextSettings(Font="Latin Modern Roman", TextHeight="50", TextGap="0", MaskColour=RGB(0, 0, 0))  # -> TextSettings, Font, TextHeight, TextGap, Mask, MaskColour, MaskMargins, MaskFrame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
unit_x = UnitX(Factor=Slider(-228, range=-1000..1000))
unit_z_5 = UnitZ(Factor=Slider(1500, range=0..2000))
calculate_same_error_as_in_rmse = Python3Script(
    center_pred=flatten(predict_axis_scaled_centered.Center),
    dir_pred=flatten(predict_axis_scaled_centered.Centroid_Brep),
    ref_point=flatten(predict_axis_scaled_centered.Centroid_Brep))  # -> out, tverrsnitt_avstand, rmse, debug_along; inputs center_pred: list of Point3d, dir_pred: list of Vector3d, ref_point: list of Point3d
# ---------- calculate_same_error_as_in_rmse: Python ----------
import math
import Rhino.Geometry as rg

# ---------- hjelp ----------
def as_list(x):
    return x if isinstance(x, (list, tuple)) else [x]

def unitize(v):
    v = rg.Vector3d(v)
    if not v.Unitize():
        raise ValueError("dir_pred har null lengde")
    return v

# ---------- hoved ----------
def cross_section_distance(center, direction, ref):
    n = unitize(direction)
    d = center - ref                 # Vector3d
    along = d * n                    # skalar (langs aksen)
    perp = d - along * n             # fjern lengdeaksen
    return perp.Length, along

# ---------- klargjør input ----------
C = as_list(center_pred)
V = as_list(dir_pred)
R = as_list(ref_point)

# broadcast hvis nødvendig
if len(V) == 1 and len(C) > 1:
    V = V * len(C)
if len(R) == 1 and len(C) > 1:
    R = R * len(C)

if not (len(C) == len(V) == len(R)):
    raise ValueError("Input-lengder må matche")

# ---------- beregning ----------
tverrsnitt_avstand = []
debug_along = []

for c, v, r in zip(C, V, R):
    d_perp, d_along = cross_section_distance(c, v, r)
    tverrsnitt_avstand.append(d_perp)
    debug_along.append(d_along)

# ---------- RMSE ----------
if len(tverrsnitt_avstand) > 0:
    rmse = math.sqrt(sum(d*d for d in tverrsnitt_avstand) / len(tverrsnitt_avstand))
else:
    rmse = float("nan")
# ---------- end calculate_same_error_as_in_rmse ----------
unit_y_3 = UnitY(Factor=Slider(284, range=-1000..1000))
move_2 = Move(Geometry=move.Geometry, Motion=unit_y_2)  # -> Geometry, Transform
move_3 = Move(Geometry=sphere_2, Motion=unit_z_4)  # -> Geometry, Transform
unit_x_2 = UnitX(Factor=Slider(-146, range=-1000..1000))
rund = Python3Script(x=calculate_same_error_as_in_rmse.tverrsnitt_avstand, decimals="3")  # -> out, a; inputs x: list of Double, decimals: Int32
# ---------- rund: Python ----------
# x: number or list
# decimals: integer  (antall sifre etter punktum i mantissen)

fmt = "{:." + str(decimals) + "e}"

if isinstance(x, (list, tuple)):
    a = [fmt.format(float(v)) for v in x]
else:
    a = fmt.format(float(x))
# ---------- end rund ----------
annotation_style = AnnotationStyle(Name="LaTeX_12pt", TextSettings=annotation_text_settings.TextSettings)  # -> AnnotationStyle, Name, ModelScale, TextSettings, DimensionSettings, ArrowSettings, UnitsSettings, LeaderSettings, ToleranceSettings
move_4 = Move(Geometry=sphere, Motion=unit_z_5)  # -> Geometry, Transform
move_5 = Move(Geometry=move_2.Geometry, Motion=unit_x)  # -> Geometry, Transform
move_6 = Move(Geometry=move.Geometry, Motion=unit_y_3)  # -> Geometry, Transform
annotation_style_2 = AnnotationStyle(Name="LaTeX_12pt", TextSettings=annotation_text_settings_2.TextSettings)  # -> AnnotationStyle, Name, ModelScale, TextSettings, DimensionSettings, ArrowSettings, UnitsSettings, LeaderSettings, ToleranceSettings
move_7 = Move(Geometry=move_6.Geometry, Motion=unit_x_2)  # -> Geometry, Transform
# Rotate solid, axis and top and bottom point
mesh_brep_2 = MeshBrep(
    Brep=merge_3,
    Settings={GridMaxCount=0, GridMinCount=16, JaggedSeams=False, MaxEdgeLength=0, MinEdgeLength=0.0001, MinTolerance=0, Refine=True, RefineAngle=0, RelativeTolerance=0.65, SimplePlanes=True, Tolerance=0})
xy_plane = XYPlane(Origin=move_5.Geometry)
# Make pointcloud
triangulate_2 = Triangulate(Mesh=mesh_brep_2)  # -> Mesh, Count
panel_12 = Panel(calculate_same_error_as_in_rmse.tverrsnitt_avstand)
custom_preview_2 = CustomPreview(Geometry=move_3.Geometry, Material=ColourSwatch(SwatchColor=RGBA(0, 76, 255, 220)))
custom_preview_3 = CustomPreview(Geometry=move_4.Geometry, Material=ColourSwatch(SwatchColor=RGBA(255, 0, 0, 160)))
xy_plane_2 = XYPlane(Origin=move_7.Geometry)
text_entity = TextEntity(Plane=xy_plane_2, Text=merge, Style=annotation_style_2.AnnotationStyle)  # -> TextEntity, Plane, Text, Style
mesh_to_pointcloud_2 = Mesh_to_PointCloud(Meshes=triangulate_2.Mesh, NrPts=set_number_of_points_on_beam, Seed=-1)  # -> PtsPerFace, PointClouds, Locations, TotalArea
fasit_vektor = Panel(merge_2)
filepath_2 = Filepath(text=["Enter filepath model", "pointnet_reg_best.pt"])
predict_axis_scaled_centered_2 = PredictAxisScaledCentered(
    PointsTree=mesh_to_pointcloud_2.Locations,
    Breps=merge_3,
    Scale="0.6",
    ModelPath=filepath_2,
    ScriptPath="Enter filpath\Run_Trained_model.py",
    Run=Toggle(True))  # -> Center, Direction, Centroid_Used, Centroid_PC, Centroid_Brep, Centroid_Delta, Log
unit_vector_3 = UnitVector(Vector=flatten(predict_axis_scaled_centered_2.Direction))
predikert_vektor = Panel(unit_vector_3)
flip_vektor = Python3Script(pred=predikert_vektor, fasit=fasit_vektor, tol=Slider(4.046, range=0..10))  # -> out, s; inputs pred: list of Vector3d, fasit: list of Vector3d, tol: Double
# ---------- flip_vektor: Python ----------
import Rhino

# pred: list of Vector3d
# fasit: list of Vector3d
# tol: float, angle tolerance in degrees

def classify(v1, v2, tol_deg):
    # Håndter null-vektorer
    if v1.IsZero or v2.IsZero:
        return 1  # eller -1, spiller egentlig liten rolle her

    # Konverter toleranse til radianer (Rhino bruker radianer)
    tol_rad = Rhino.RhinoMath.ToRadians(tol_deg)

    # IsParallelTo returnerer:
    #  1  = parallell (samme retning)
    # -1  = antiparallell (motsatt retning)
    #  0  = ikke innenfor toleranse
    rel = v1.IsParallelTo(v2, tol_rad)

    if rel == 1:
        return 1
    elif rel == -1:
        return -1
    else:
        # Fall-back: bruk dot-produktet til å bestemme fortegn
        dp = v1 * v2  # overloaded operator
        return 1 if dp >= 0 else -1

# Sørg for at listene har samme lengde
n = min(len(pred), len(fasit))
s = []

for i in range(n):
    v1 = pred[i]
    v2 = fasit[i]
    s.append(classify(v1, v2, tol))
# ---------- end flip_vektor ----------
multiplication_7 = Multiplication(A=unit_vector_3, B=flip_vektor.s)
angle = Angle(VectorA=fasit_vektor, VectorB=multiplication_7)  # -> Angle, Reflex
degrees = Degrees(Radians=angle.Angle)
feil_i_grader = Panel(degrees)
analytical_lines_localbbox = Analytical_LinesLocalBBox(
    Center=predict_axis_scaled_centered_2.Center,
    Direction=predict_axis_scaled_centered_2.Direction,
    Geometry=merge_3,
    Extend=Slider(0, range=-100..1000))  # -> AxisLine, P1, P2, BBoxLocal, BBoxCorners, Log
number_slider_3 = Slider(3.788, range=0..10)
panel_13 = Panel("""{0,0,0}
{0,1000,0}
{0,0,-1000}
{0,1000,-1000}
{0,0,-2000}
{0,1000,-2000}""")
panel_14 = Panel("""{0,0,0}
{0,0,0}
{0,0,0}
{0,0,0}
{0,0,0}
{0,0,0}""")

# ----
# Local boundingbox
panel_15 = Panel("30")
sphere_3 = Sphere(Base=flatten(analytical_lines_localbbox.P1), Radius=panel_15)
sphere_4 = Sphere(Base=flatten(analytical_lines_localbbox.P2), Radius=panel_15)
line_3 = Line(StartPoint=flatten(analytical_lines_localbbox.P1), EndPoint=flatten(analytical_lines_localbbox.P2))  # -> flatten(Line)
display_3 = Display(geometry=flatten(line_3), point_a=panel_14, point_b=panel_13, B=number_slider_3)
display_4 = Display(geometry=flatten(sphere_3), point_a=panel_14, point_b=panel_13, B=number_slider_3)
display_5 = Display(geometry=flatten(sphere_4), point_a=panel_14, point_b=panel_13, B=number_slider_3)

# ----
# Pointcloud display
display_6 = Display(geometry=mesh_to_pointcloud_2.PointClouds, point_a=panel_14, point_b=panel_13, B=number_slider_3)
custom_preview_4 = CustomPreview(Geometry=display_6, Material=ColourSwatch(SwatchColor=RGB(0, 242, 255)))

unit_y_4 = UnitY(Factor=Slider(754, range=-3000..3000))
unit_z_6 = UnitZ(Factor=Slider(305, range=-3000..3000))
display_7 = Display(geometry=rotate_3d.Geometry, point_a=panel_14, point_b=panel_13, B=number_slider_3)
display_8 = Display(geometry=merge_3, point_a=panel_14, point_b=panel_13, B=number_slider_3)
unit_y_5 = UnitY(Factor=Slider(1603, range=-3000..3000))
unit_z_7 = UnitZ(Factor=Slider(1365, range=-3000..3000))
move_8 = Move(Geometry=display_7, Motion=unit_y_5)  # -> Geometry, Transform
move_9 = Move(Geometry=move_8.Geometry, Motion=unit_z_7)  # -> Geometry, Transform
panel_16 = Panel("100")
area_2 = Area(Geometry=move_9.Geometry)  # -> Area, Centroid
unit_z_8 = UnitZ(Factor=Slider(335, range=-1000..1000))
unit_y_6 = UnitY(Factor=Slider(-226, range=-1000..1000))
panel_17 = Panel("""0
30
45
60
75
90""")
move_10 = Move(Geometry=area_2.Centroid, Motion=unit_z_8)  # -> Geometry, Transform
move_11 = Move(Geometry=move_10.Geometry, Motion=unit_y_6)  # -> Geometry, Transform
annotation_text_settings_3 = AnnotationTextSettings(Font="Latin Modern Roman", TextHeight="135", TextGap="0", MaskColour=RGB(0, 0, 0))  # -> TextSettings, Font, TextHeight, TextGap, Mask, MaskColour, MaskMargins, MaskFrame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
annotation_style_3 = AnnotationStyle(Name="LaTeX_12pt", TextSettings=annotation_text_settings_3.TextSettings)  # -> AnnotationStyle, Name, ModelScale, TextSettings, DimensionSettings, ArrowSettings, UnitsSettings, LeaderSettings, ToleranceSettings
camera_view = Python3Script()  # -> out, N; same code as camera_view
annotation_text_settings_4 = AnnotationTextSettings(Font="Latin Modern Roman", TextHeight="135", TextGap="0", MaskColour=RGB(0, 0, 0))  # -> TextSettings, Font, TextHeight, TextGap, Mask, MaskColour, MaskMargins, MaskFrame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
annotation_text_settings_5 = AnnotationTextSettings(Font="Latin Modern Roman", TextHeight="135", TextGap="0", MaskColour=RGB(0, 0, 0))  # -> TextSettings, Font, TextHeight, TextGap, Mask, MaskColour, MaskMargins, MaskFrame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
annotation_text_settings_6 = AnnotationTextSettings(Font="Latin Modern Roman", TextHeight="135", TextGap="0", MaskColour=RGB(0, 0, 0))  # -> TextSettings, Font, TextHeight, TextGap, Mask, MaskColour, MaskMargins, MaskFrame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
annotation_text_settings_7 = AnnotationTextSettings(Font="Latin Modern Roman", TextHeight="135", TextGap="0", MaskColour=RGB(0, 0, 0))  # -> TextSettings, Font, TextHeight, TextGap, Mask, MaskColour, MaskMargins, MaskFrame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
yz_plane = YZPlane(Origin=move_11.Geometry)
camera_view_2 = Python3Script()  # -> out, N; same code as camera_view
camera_view_3 = Python3Script()  # -> out, N; same code as camera_view
annotation_style_4 = AnnotationStyle(Name="LaTeX_12pt", TextSettings=annotation_text_settings_4.TextSettings)  # -> AnnotationStyle, Name, ModelScale, TextSettings, DimensionSettings, ArrowSettings, UnitsSettings, LeaderSettings, ToleranceSettings
camera_view_4 = Python3Script()  # -> out, N; same code as camera_view
camera_view_5 = Python3Script()  # -> out, N; same code as camera_view
plane_frome_kameraview = PlaneFromeKameraview(vector_b=camera_view_2.N, origin=move_11.Geometry)
orient = Orient(Geometry=move_9.Geometry, Source=yz_plane, Target=plane_frome_kameraview)  # -> Geometry, Transform
annotation_style_5 = AnnotationStyle(Name="LaTeX_12pt", TextSettings=annotation_text_settings_5.TextSettings)  # -> AnnotationStyle, Name, ModelScale, TextSettings, DimensionSettings, ArrowSettings, UnitsSettings, LeaderSettings, ToleranceSettings
annotation_style_6 = AnnotationStyle(Name="LaTeX_12pt", TextSettings=annotation_text_settings_6.TextSettings)  # -> AnnotationStyle, Name, ModelScale, TextSettings, DimensionSettings, ArrowSettings, UnitsSettings, LeaderSettings, ToleranceSettings
camera_view_6 = Python3Script()  # -> out, N; same code as camera_view
annotation_style_7 = AnnotationStyle(Name="LaTeX_12pt", TextSettings=annotation_text_settings_7.TextSettings)  # -> AnnotationStyle, Name, ModelScale, TextSettings, DimensionSettings, ArrowSettings, UnitsSettings, LeaderSettings, ToleranceSettings
text_entity_2 = TextEntity(Plane=plane_frome_kameraview, Text=merge, Style=annotation_style_4.AnnotationStyle)  # -> TextEntity, Plane, Text, Style
text_tag = TextTag(Location=move_11.Geometry, Text=merge, Colour=RGB(0, 0, 0))
custom_preview_5 = CustomPreview(Geometry=orient.Geometry, Material=ColourSwatch(SwatchColor=RGB(0, 0, 0)))

# ----
# Axis
number_slider_4 = Slider(1700, range=0..10000)
unit_x_3 = UnitX(Factor=1)
unit_y_7 = UnitY(Factor=1)
unit_z_9 = UnitZ(Factor=1)
panel_22 = Panel("""4
5""")
panel_23 = Panel("""2
3""")
panel_24 = Panel("""0
1""")
unit_z_10 = UnitZ(Factor=Slider(-1890, range=-3000..3000))
unit_z_11 = UnitZ(Factor=Slider(-2257, range=-3000..3000))
unit_z_12 = UnitZ(Factor=Slider(-2512, range=-3000..3000))
number_slider_5 = Slider(131, range=0..200)
unit_x_4 = UnitX(Factor=number_slider_5)
unit_z_13 = UnitZ(Factor=number_slider_5)
unit_y_8 = UnitY(Factor=number_slider_5)
concatenate = Concatenate(Fragment_A="Rotation: ", Fragment_B=panel_17, A="°")

annotation_text_settings_8 = AnnotationTextSettings(Font="Latin Modern Roman", TextHeight="135", TextGap="0", MaskColour=RGB(0, 0, 0))  # -> TextSettings, Font, TextHeight, TextGap, Mask, MaskColour, MaskMargins, MaskFrame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
annotation_style_8 = AnnotationStyle(Name="LaTeX_12pt", TextSettings=annotation_text_settings_8.TextSettings)  # -> AnnotationStyle, Name, ModelScale, TextSettings, DimensionSettings, ArrowSettings, UnitsSettings, LeaderSettings, ToleranceSettings

# ----
# Fasit axis
number_slider_6 = Slider(1500, range=0..6000)
construct_point_3 = ConstructPoint(XCoordinate=0, YCoordinate=0, ZCoordinate=0)
line_sdl_2 = LineSDL(Start=construct_point_3, Direction=fasit_vektor, Length=number_slider_6)
display_9 = Display(geometry=line_sdl_2, point_a=panel_14, point_b=panel_13, B=number_slider_3)
pipe = Pipe(Curve=display_9, Radius="4", Caps=0, FitRail=False)  # -> flatten(Pipe)

line_sdl_3 = LineSDL(Start=construct_point_3, Direction=unit_z_9, Length=number_slider_4)
line_sdl_4 = LineSDL(Start=construct_point_3, Direction=unit_y_7, Length=number_slider_4)
line_sdl_5 = LineSDL(Start=construct_point_3, Direction=unit_x_3, Length=number_slider_4)
display_10 = Display(geometry=line_sdl_3, point_a=panel_14, point_b=panel_13, B=number_slider_3)
display_11 = Display(geometry=line_sdl_5, point_a=panel_14, point_b=panel_13, B=number_slider_3)
display_12 = Display(geometry=line_sdl_4, point_a=panel_14, point_b=panel_13, B=number_slider_3)
end_points_2 = EndPoints(Curve=display_11)  # -> Start, End
end_points_3 = EndPoints(Curve=display_12)  # -> Start, End
end_points_4 = EndPoints(Curve=display_10)  # -> Start, End
list_item_15 = ListItem(List=end_points_4.End, Index=panel_22, Wrap=True)
list_item_16 = ListItem(List=end_points_4.End, Index=panel_23, Wrap=True)
list_item_17 = ListItem(List=end_points_4.End, Index=panel_24, Wrap=True)
custom_preview_6 = CustomPreview(Geometry=[display_10, display_12, display_11], Material=ColourSwatch(SwatchColor=RGB(0, 0, 0)))
move_12 = Move(Geometry=list_item_15, Motion=unit_z_10)  # -> Geometry, Transform
move_13 = Move(Geometry=list_item_16, Motion=unit_z_11)  # -> Geometry, Transform
move_14 = Move(Geometry=list_item_17, Motion=unit_z_12)  # -> Geometry, Transform
merge_4 = Merge(Data1=move_14.Geometry, Data2=move_13.Geometry, Data3=move_12.Geometry)
panel_25 = Panel(merge_4)
move_15 = Move(Geometry=end_points_2.End, Motion=unit_x_4)  # -> Geometry, Transform
move_16 = Move(Geometry=end_points_4.End, Motion=unit_z_13)  # -> Geometry, Transform
move_17 = Move(Geometry=end_points_3.End, Motion=unit_y_8)  # -> Geometry, Transform
text_tag_2 = TextTag(Location=move_16.Geometry, Text="Z", Colour=RGB(0, 0, 0))
text_tag_3 = TextTag(Location=move_17.Geometry, Text="Y", Colour=RGB(0, 0, 0))
text_tag_4 = TextTag(Location=merge_4, Text=concatenate, Colour=RGB(0, 0, 0))

text_tag_5 = TextTag(Location=move_15.Geometry, Text="X", Colour=RGB(0, 0, 0))
plane_frome_kameraview_2 = PlaneFromeKameraview(vector_b=camera_view_4.N, origin=move_15.Geometry)
plane_frome_kameraview_3 = PlaneFromeKameraview(vector_b=camera_view_5.N, origin=move_17.Geometry)
plane_frome_kameraview_4 = PlaneFromeKameraview(vector_b=camera_view_3.N, origin=move_16.Geometry)
plane_frome_kameraview_5 = PlaneFromeKameraview(vector_b=camera_view_6.N, origin=merge_4)
text_entity_3 = TextEntity(Plane=plane_frome_kameraview_2, Text="X", Style=annotation_style_8.AnnotationStyle)  # -> TextEntity, Plane, Text, Style
text_entity_4 = TextEntity(Plane=plane_frome_kameraview_4, Text="Z", Style=annotation_style_5.AnnotationStyle)  # -> TextEntity, Plane, Text, Style
text_entity_5 = TextEntity(Plane=plane_frome_kameraview_3, Text="Y", Style=annotation_style_6.AnnotationStyle)  # -> TextEntity, Plane, Text, Style
text_entity_6 = TextEntity(Plane=plane_frome_kameraview_5, Text=concatenate, Style=annotation_style_7.AnnotationStyle)  # -> TextEntity, Plane, Text, Style

# ----
# Text for error
end_points_5 = EndPoints(Curve=line_sdl_2)  # -> Start, End
display_13 = Display(geometry=end_points_5.Start, point_a=panel_14, point_b=panel_13, B=number_slider_3)
rund_2 = Python3Script(x=degrees, decimals="3")  # -> out, a; inputs x: list of Double, decimals: Int32
# ---------- rund_2: Python ----------
# x: number or list
# decimals: integer

fmt = "{:." + str(decimals) + "f}"

if isinstance(x, (list, tuple)):
    a = [fmt.format(v) for v in x]
else:
    a = fmt.format(x)
# ---------- end rund_2 ----------
concatenate_2 = Concatenate(Fragment_A="Error: ", Fragment_B=rund_2.a, A="°")

concatenate_3 = Concatenate(Fragment_A="Error: ", Fragment_B=rund.a, A=" mm")
text_entity_7 = TextEntity(Plane=xy_plane, Text=concatenate_3, Style=annotation_style.AnnotationStyle)  # -> TextEntity, Plane, Text, Style
point_2 = Point(end_points_5.Start)
move_18 = Move(Geometry=display_13, Motion=unit_y_4)  # -> Geometry, Transform
move_19 = Move(Geometry=move_18.Geometry, Motion=unit_z_6)  # -> Geometry, Transform

text_tag_6 = TextTag(Location=move_19.Geometry, Text=concatenate_2, Colour=RGB(0, 0, 0))

plane_frome_kameraview_6 = PlaneFromeKameraview(vector_b=camera_view.N, origin=move_19.Geometry)
text_entity_8 = TextEntity(Plane=plane_frome_kameraview_6, Text=concatenate_2, Style=annotation_style_3.AnnotationStyle)  # -> TextEntity, Plane, Text, Style

# ----
# Predicted axis
number_slider_7 = Slider(1500, range=0..6000)
colour_swatch = ColourSwatch(SwatchColor=RGB(255, 3, 3))

# ----
# Predicted point
point_3 = Point(flatten(predict_axis_scaled_centered_2.Center))
display_14 = Display(geometry=point_3, point_a=panel_14, point_b=panel_13, B=number_slider_3)
sphere_5 = Sphere(Base=display_14, Radius="70")
custom_preview_7 = CustomPreview(Geometry=sphere_5, Material=colour_swatch)

# ----
# Fasit point
volume = Volume(Geometry=merge_3)  # -> Volume, Centroid
display_15 = Display(geometry=volume.Centroid, point_a=panel_14, point_b=panel_13, B=number_slider_3)
sphere_6 = Sphere(Base=display_15, Radius="70")
colour_swatch_2 = ColourSwatch(SwatchColor=RGB(7, 3, 255))
custom_preview_8 = CustomPreview(Geometry=sphere_6, Material=colour_swatch_2)

line_sdl_6 = LineSDL(Start=point_3, Direction=multiplication_7, Length=number_slider_7)
display_16 = Display(geometry=line_sdl_6, point_a=panel_14, point_b=panel_13, B=number_slider_3)
pipe_2 = Pipe(Curve=display_16, Radius="10", Caps=0, FitRail=False)  # -> flatten(Pipe)
custom_preview_9 = CustomPreview(Geometry=pipe_2, Material=colour_swatch)

custom_preview_10 = CustomPreview(Geometry=pipe, Material=colour_swatch_2)

# ==== cluster Filepath
text = ClusterInput()
text_join = TextJoin(Text=text, Join="\")
result = ClusterOutput(text_join)

# ==== cluster Display
point_a = ClusterInput()
point_b = ClusterInput()
vector_2pt = Vector2Pt(PointA=point_a, PointB=point_b, Unitize=False)  # -> Vector, Length
B = ClusterInput()
multiplication = Multiplication(A=vector_2pt.Vector, B=B)
geometry = ClusterInput()
move = Move(Geometry=geometry, Motion=multiplication)  # -> Geometry, Transform
geometry_2 = ClusterOutput(move.Geometry)

# ==== cluster PlaneFromeKameraview
camera_view = Python3Script()  # -> out, N
# ---------- camera_view: Python ----------
import Rhino

view = Rhino.RhinoDoc.ActiveDoc.Views.ActiveView
cam = view.ActiveViewport.CameraDirection


N = -cam
# ---------- end camera_view ----------
unit_z = UnitZ(Factor=1)
vector_b = ClusterInput()
cross_product = CrossProduct(VectorA=unit_z, VectorB=vector_b, Unitize=False)  # -> Vector, Length
cross_product_2 = CrossProduct(VectorA=vector_b, VectorB=cross_product.Vector, Unitize=False)  # -> Vector, Length
origin = ClusterInput()
construct_plane = ConstructPlane(Origin=origin, XAxis=cross_product.Vector, YAxis=cross_product_2.Vector)
plane = ClusterOutput(construct_plane)
