# Grasshopper definition CaseStudy5.gh (Grasshopper 1.0.8)
# plug-ins: Analytical_model_fast, End Point Predictor, Speckle.Connector.Grasshopper

# ----
# Load model from Speckle
panel = Panel("https://app.speckle.systems/projects/70d94465f6/models/453a757124")
sign_in = SignIn(ServerUrl=panel)
speckle_model = SpeckleModel(SpeckleUrl=panel, Server="https://app.speckle.systems", User="6DBF9B036E673D15A4534E10C62B1B61")
panel_2 = Panel(sign_in)
load = Load(SpeckleModel=speckle_model, AutoReceive=False)  # -> Collection, Properties
collection_selector = CollectionSelector(load.Collection, AutoSelectAllItems=False)
query_speckle_objects = QuerySpeckleObjects(Collection=load.Collection)
custom_preview = CustomPreview(Geometry=query_speckle_objects, Material=ColourSwatch(SwatchColor=RGBA(150, 150, 150, 113)))
speckle_data_object = SpeckleDataObject(SpeckleDataObject=query_speckle_objects)  # -> SpeckleDataObject, flatten(Geometries), Name, Properties, Path

# ----
# Beams
panel_3 = Panel("M_W-Wide Flange:")
filter = Python3Script(x=flatten(speckle_data_object.Geometries), y=panel_3)  # -> out, a; inputs x: list of String, y: String
# ---------- filter: Python ----------
list1 = []

for t in x:
    if y in t:
        if not z:              # z er tomt -> ikke filter på z
            list1.append(True)
        elif z not in t:       # z har verdi og finnes ikke i teksten
            list1.append(True)
        else:
            list1.append(False)
    else:
        list1.append(False)

a = list1
# ---------- end filter ----------
dispatch = Dispatch(List=flatten(speckle_data_object.Geometries), DispatchPattern=filter.a)  # -> ListA, ListB
speckle_geometry = SpeckleGeometry(SpeckleGeometry=dispatch.ListA)  # -> SpeckleGeometry, Geometry, Name, Properties, Color, Material, Path
volume = Volume(Geometry=speckle_geometry.Geometry)  # -> Volume, Centroid
sort_list = SortList(Keys=volume.Volume, ValuesValuesA=speckle_geometry.Geometry)  # -> Keys, ValuesValuesA
construct_domain = ConstructDomain(DomainStart="0", DomainEnd="14")
range = Range(Domain=construct_domain, Steps="14")
cull_index = CullIndex(List=sort_list.ValuesValuesA, Indices=range, Wrap=True)
colour_swatch = ColourSwatch(SwatchColor=RGB(255, 0, 0))
triangulate = Triangulate(Mesh=cull_index)  # -> Mesh, Count
custom_preview_2 = CustomPreview(Geometry=cull_index, Material=ColourSwatch(SwatchColor=RGBA(51, 27, 27, 50)))
set_number_of_points_on_beam = Panel("1024")
make_pointcloud = Make_pointcloud(Meshes=triangulate.Mesh, NrPts=set_number_of_points_on_beam, Seed=-1)  # -> PtsPerFace, PointClouds, Locations, TotalArea
scale = Panel("0.4")
filepath = Filepath(text=["Enter filepath\ResultFiles38000", "pointnet_reg_best.pt"])
predict_axis_scaled_centered = PredictAxisScaledCentered(
    PointsTree=make_pointcloud.Locations,
    Scale=scale,
    ModelPath=filepath,
    ScriptPath="Enter_filepath\Run_Trained_model.py",
    Run=Toggle(True))  # -> Center, Direction, Center_scaled, Direction_scaled, Log
make_analytical_lines_localbbox = Make_analytical_Lines_LocalBBox(
    Center=predict_axis_scaled_centered.Center,
    Direction=predict_axis_scaled_centered.Direction,
    Geometry=cull_index,
    Extend=0)  # -> AxisLine, P1, P2, BBoxLocal, BBoxCorners, Log
line = Line(StartPoint=make_analytical_lines_localbbox.P1, EndPoint=make_analytical_lines_localbbox.P2)
pipe = Pipe(Curve=line, Radius="20", Caps=0, FitRail=False)
sphere = Sphere(Base=flatten([make_analytical_lines_localbbox.P1, make_analytical_lines_localbbox.P2]), Radius="100")
custom_preview_3 = CustomPreview(Geometry=flatten([pipe, sphere]), Material=ColourSwatch(SwatchColor=RGB(0, 0, 0)))

panel_4 = Panel(speckle_geometry.SpeckleGeometry)
mesh_to_pointcloud = Mesh_to_PointCloud(NrPts=1024, Seed=-1)  # -> PtsPerFace, PointClouds, Locations, TotalArea
predict_axis_scaled_centered_2 = PredictAxisScaledCentered(Scale=1, Run=False)  # -> Center, Direction, Centroid_Used, Centroid_PC, Centroid_Brep, Centroid_Delta, Log
analytical_lines_localbbox = Analytical_LinesLocalBBox(Extend=0)  # -> AxisLine, P1, P2, BBoxLocal, BBoxCorners, Log

# ----
# Columns
panel_5 = Panel("-Column:")
filter_2 = Python3Script(x=flatten(speckle_data_object.Geometries), y=panel_5, z="M_Concrete")  # -> out, a; inputs x: list of String, y: String; same code as filter
dispatch_2 = Dispatch(List=flatten(speckle_data_object.Geometries), DispatchPattern=filter_2.a)  # -> ListA, ListB
speckle_geometry_2 = SpeckleGeometry(SpeckleGeometry=dispatch_2.ListA)  # -> SpeckleGeometry, Geometry, Name, Properties, Color, Material, Path
colour_swatch_2 = ColourSwatch(SwatchColor=RGB(240, 0, 0))
set_number_of_points_on_beam_2 = Panel("1024")
custom_preview_4 = CustomPreview(Geometry=speckle_geometry_2.Geometry, Material=ColourSwatch(SwatchColor=RGBA(47, 71, 67, 50)))
scale_2 = Panel("0.4")
filepath_2 = Filepath(text=["Enter filepath\ResultFiles38000", "pointnet_reg_best.pt"])

merge = Merge(Data1=speckle_geometry_2.Geometry, Data2=cull_index)  # -> flatten(Result)

# ----
# Filtered out elements
speckle_geometry_3 = SpeckleGeometry(SpeckleGeometry=[dispatch_2.ListB, dispatch.ListB])  # -> SpeckleGeometry, Geometry, Name, Properties, Color, Material, Path
custom_preview_5 = CustomPreview(Geometry=speckle_geometry_3.Geometry, Material=ColourSwatch(SwatchColor=RGBA(0, 0, 0, 0)))

triangulate_2 = Triangulate(Mesh=merge)  # -> Mesh, Count

mesh_to_pointcloud_2 = Mesh_to_PointCloud(Meshes=triangulate_2.Mesh, NrPts=set_number_of_points_on_beam_2, Seed=-1)  # -> PtsPerFace, PointClouds, Locations, TotalArea

predict_axis_scaled_centered_3 = PredictAxisScaledCentered(
    PointsTree=mesh_to_pointcloud_2.Locations,
    Breps=speckle_geometry_2.Geometry,
    Scale=scale_2,
    ModelPath=filepath_2,
    ScriptPath="Enter_filepath\Run_Trained_model.py",
    Run=Toggle(True))  # -> Center, Direction, Centroid_Used, Centroid_PC, Centroid_Brep, Centroid_Delta, Log
analytical_lines_localbbox_2 = Analytical_LinesLocalBBox(
    Center=predict_axis_scaled_centered_3.Center,
    Direction=predict_axis_scaled_centered_3.Direction,
    Geometry=speckle_geometry_2.Geometry,
    Extend=0)  # -> AxisLine, P1, P2, BBoxLocal, BBoxCorners, Log
line_2 = Line(StartPoint=analytical_lines_localbbox_2.P1, EndPoint=analytical_lines_localbbox_2.P2)
sphere_2 = Sphere(Base=flatten([analytical_lines_localbbox_2.P1, analytical_lines_localbbox_2.P2]), Radius="100")
pipe_2 = Pipe(Curve=line_2, Radius="20", Caps=0, FitRail=False)
custom_preview_6 = CustomPreview(Geometry=flatten([pipe_2, sphere_2]), Material=ColourSwatch(SwatchColor=RGB(0, 0, 0)))

# ----
# Short beams are sorted out and run with scale 1
list_item = ListItem(List=sort_list.ValuesValuesA, Index=range, Wrap=True)
colour_swatch_3 = ColourSwatch(SwatchColor=RGBA(33, 33, 33, 50))
triangulate_3 = Triangulate(Mesh=list_item)  # -> Mesh, Count
custom_preview_7 = CustomPreview(Geometry=list_item, Material=ColourSwatch(SwatchColor=RGBA(255, 0, 0, 120)))
set_number_of_points_on_beam_3 = Panel("1024")
scale_3 = Panel("1")
filepath_3 = Filepath(text=["Enter filepath\ResultFiles38000", "pointnet_reg_best.pt"])

mesh_to_pointcloud_3 = Mesh_to_PointCloud(Meshes=triangulate_3.Mesh, NrPts=set_number_of_points_on_beam_3, Seed=-1)  # -> PtsPerFace, PointClouds, Locations, TotalArea
predict_axis_scaled_centered_4 = PredictAxisScaledCentered(
    PointsTree=mesh_to_pointcloud_3.Locations,
    Breps=list_item,
    Scale=scale_3,
    ModelPath=filepath_3,
    ScriptPath="Enter_filepath\Run_Trained_model.py",
    Run=Toggle(True))  # -> Center, Direction, Centroid_Used, Centroid_PC, Centroid_Brep, Centroid_Delta, Log
analytical_lines_localbbox_3 = Analytical_LinesLocalBBox(
    Center=predict_axis_scaled_centered_4.Center,
    Direction=predict_axis_scaled_centered_4.Direction,
    Geometry=list_item,
    Extend=0)  # -> AxisLine, P1, P2, BBoxLocal, BBoxCorners, Log

line_3 = Line(StartPoint=analytical_lines_localbbox_3.P1, EndPoint=analytical_lines_localbbox_3.P2)
pipe_3 = Pipe(Curve=line_3, Radius="20", Caps=0, FitRail=False)
sphere_3 = Sphere(Base=flatten([analytical_lines_localbbox_3.P1, analytical_lines_localbbox_3.P2]), Radius="100")
custom_preview_8 = CustomPreview(Geometry=flatten([pipe_3, sphere_3]), Material=ColourSwatch(SwatchColor=RGB(0, 0, 0)))

# ==== cluster Filepath
text = ClusterInput()
text_join = TextJoin(Text=text, Join="\")
result = ClusterOutput(text_join)
