# Grasshopper definition Generate dataset.gh (Grasshopper 1.0.8)
# plug-ins: Analytical_model_New, FEM-Design

set_number_of_points_on_beam = Panel("1024")
rotasjon_om_1_akse_0_hvis_vi_ikke_skal_r = Panel("179")  # "Rotasjon om 1. akse. 0 hvis vi ikke skal rotere"
rotasjon_om_3_akse_0_hvis_vi_ikke_skal_r = Panel("0")  # "Rotasjon om 3. akse. 0 hvis vi ikke skal rotere"
rotasjon_om_2_akse_0_hvis_vi_ikke_skal_r = Panel("0")  # "Rotasjon om 2. akse. 0 hvis vi ikke skal rotere"
filename = Panel("Type_1_")
number_slider = Slider(0, range=0..1000)
scale = Panel("0.4")
number_slider_2 = Slider(5, range=0..30000)
number_slider_3 = Slider(6, range=0..10)

# ----
# Adjsut W,H and L domain
h_and_w_max = Slider(250, range=0..2000)
h_and_w_min = Slider(100, range=0..2000)
l_min = Slider(1000, range=1..15000)
l_max = Slider(6000, range=0..15000)
construct_domain = ConstructDomain(DomainStart=h_and_w_min, DomainEnd=h_and_w_max)
construct_domain_2 = ConstructDomain(DomainStart=l_min, DomainEnd=l_max)

multiplication = Multiplication(A=set_number_of_points_on_beam, B="1")
negative = Negative(Value=number_slider)
panel = Panel("CHS")
random_points = Python3Script(
    count=number_slider_2,
    xmin=negative,
    xmax=number_slider,
    ymin=negative,
    ymax=number_slider,
    zmin=negative,
    zmax=number_slider,
    grid_cols=Slider(20000, range=0..20000),
    grid_dx=number_slider_3,
    grid_dy=number_slider_3)  # -> out, flatten(pts), pts_grid; inputs count: Int32
# ---------- random_points: Python ----------
"""
Genererer tilfeldige punkter (Point3d) innenfor oppgitt område
OG lager en visualiserings-grid av de samme punktene.

Inputs:
    count : antall punkter (int)
    xmin, xmax : min og maks for X
    ymin, ymax : min og maks for Y
    zmin, zmax : min og maks for Z
    grid_cols : antall kolonner i visualiserings-grid (int)
    grid_dx : avstand mellom punkter i X-retning i grid (float)
    grid_dy : avstand mellom punkter i Y-retning i grid (float)

Outputs:
    pts : liste med originale Rhino.Geometry.Point3d
    pts_grid : samme punkter lagt ut på et rutenett (kun for visualisering)
"""

import Rhino.Geometry as rg
import random

# --- Defaultverdier hvis input ikke er koblet til ---
count  = count  if 'count'  in globals() else 10
xmin   = xmin   if 'xmin'   in globals() else 0.0
xmax   = xmax   if 'xmax'   in globals() else 10.0
ymin   = ymin   if 'ymin'   in globals() else 0.0
ymax   = ymax   if 'ymax'   in globals() else 10.0
zmin   = zmin   if 'zmin'   in globals() else 0.0
zmax   = zmax   if 'zmax'   in globals() else 10.0

# Grid-parameter (for visualisering)
grid_cols = grid_cols if 'grid_cols' in globals() else 10   # antall kolonner
grid_dx   = grid_dx   if 'grid_dx'   in globals() else 5.0  # avstand i X
grid_dy   = grid_dy   if 'grid_dy'   in globals() else 5.0  # avstand i Y

# --- Generer tilfeldige punkter ---
pts = []
for _ in range(count):
    x = random.uniform(xmin, xmax)
    y = random.uniform(ymin, ymax)
    z = random.uniform(zmin, zmax)
    pts.append(rg.Point3d(x, y, z))

# --- Lag grid-versjon av punktene for visualisering ---
pts_grid = []

for i, p in enumerate(pts):
    # rad/kolonne basert på indeks
    col = i % grid_cols           # hvilken kolonne punkt i havner i
    row = i // grid_cols          # hvilken rad punkt i havner i

    gx = col * grid_dx            # X-posisjon på grid
    gy = row * grid_dy            # Y-posisjon på grid
    gz = p.Z                      # beholder Z (evt. sett til 0.0 hvis du vil ha flatt grid)

    pts_grid.append(rg.Point3d(gx, gy, gz))
# ---------- end random_points ----------
sectiondatabase = SectionDatabase()  # -> SteelSection, ConcreteSection, TimberSection, HollowCoreSection, CustomSection
search_names = Python3Script(Sections=sectiondatabase.SteelSection, Search="Steel section, U,")  # -> out, Matches; inputs Sections: list
# ---------- search_names: Python ----------
"""
Inputs:
    Sections: Liste med tekststrenger (f.eks. fra Panel)
    Search:   Tekst å søke etter (substring)
Outputs:
    Matches:  Alle entries som inneholder søketeksten
"""

# Håndter litt fleksibel input
matches = []

# Sørg for at vi har noe å søke etter
if Search is not None:
    search_str = str(Search).strip()
else:
    search_str = ""

if search_str and Sections:
    # Hvis Sections er én lang tekst, splitt til liste
    if isinstance(Sections, str):
        sections_list = Sections.splitlines()
    else:
        sections_list = list(Sections)

    # Case-insensitivt søk (IPE == ipe)
    search_lower = search_str.lower()
    for s in sections_list:
        if search_lower in str(s).lower():
            matches.append(s)

# Output til Grasshopper
Matches = matches
# ---------- end search_names ----------
panel_2 = Panel(search_names.Matches)
point = Point(random_points.pts)
panel_3 = Panel("CHS298.5-10.0")
panel_4 = Panel("IPE300")
panel_5 = Panel("U300")
list_length = ListLength(List=point)
section_getsectionbyname_index = SectionGetSectionByNameIndex(Sections=sectiondatabase.SteelSection, SectionNameIndex=search_names.Matches)
panel_6 = Panel("LU")
panel_7 = Panel("U")
panel_8 = Panel("IPE")
random = Random(Range=construct_domain, Number=list_length, Seed="2")
panel_10 = Panel("HE-A")
random_2 = Random(Range=construct_domain, Number=list_length, Seed="1")
random_3 = Random(Range=construct_domain_2, Number=list_length, Seed="3")
# Make unique Info: Explanation of Parameters
# 
# min_step (minimum difference enforced):
# Ensures that at least one of the beam dimensions (L/W/H) differs by at least this amount.
# This guarantees a real geometric difference, not just a numerical adjustment.
# Example (model in meters):
# min_step = 0.01 → at least 1 cm difference in one dimension.
# Use this when you want a clear minimum variation between beams.
# 
# tol (tolerance for similarity):
# Determines how close two beam dimensions can be before they are considered identical.
# Choose a value that makes sense in your model’s units.
# Example (model in meters): tol = 0.005 means differences smaller than 5 mm are treated as the same.
# 
# jitter (adjustment amount):
# Controls how much each duplicate is nudged per iteration, relative to tol.
# Example: jitter = 0.3 means each adjustment is about 30% of tol per iteration.
# Increase jitter if duplicates still remain after several iterations.
# 
# max_iters (maximum iterations):
# The number of times the script is allowed to attempt making all beams unique.
# If duplicates still remain, increase this value.
# 
# Important: Grasshopper uses the same units as the Rhino document.
# Check your model units in Rhino here:
# File → Properties → Units
# 
# For example, if your model is in meters, then:
# 0.01 = 1 cm, 0.001 = 1 mm in Grasshopper.
nr_of_beams = Panel(list_length)
panel_11 = Panel(random_2)
section_deconstruct = SectionDeconstruct(Section=section_getsectionbyname_index)  # -> Guid, Name, flatten(Surfaces), SectionType, MaterialType, GroupName, TypeName, SizeName
min_difference = Slider(5, range=0..100)
tolerance = Slider(0, range=0..100)
make_unique = Python3Script(W=random_2, H=random, L=random_3, tol=tolerance, jitter="0.3", max_iters="15", min_step=min_difference)  # -> out, flatten(W_out), flatten(H_out), flatten(L_out), Report; inputs W: list of Double, H: list of Double, L: list of Double, tol: Double, jitter: Int32, max_iters: Int32, min_step: Double
# ---------- make_unique: Python ----------
"""
Auto-unique L/W/H with readable duplicate output.
"""

# ---------- defaults/guards ----------
if tol is None or tol <= 0: tol = 1e-6
if jitter is None: jitter = 0.25
if max_iters is None or max_iters < 1: max_iters = 5

# match lengths
n = min(len(L or []), len(W or []), len(H or []))
L = list((L or [])[:n])
W = list((W or [])[:n])
H = list((H or [])[:n])

# --- snap dimensions to enforce minimum difference (e.g. 1cm = 0.01m) ---
if min_step is None: 
    min_step = 0.01  # fallback

def snap(v, step):
    return round(v / step) * step

L = [snap(v, min_step) for v in L]
W = [snap(v, min_step) for v in W]
H = [snap(v, min_step) for v in H]


def q(v, t):
    # quantize to an integer grid of size tol
    return int(round(v / t)) if t > 0 else v

def key_for(i):
    return (q(L[i], tol), q(W[i], tol), q(H[i], tol))

def find_duplicates():
    buckets = {}
    for i in range(n):
        k = key_for(i)
        buckets.setdefault(k, []).append(i)
    return [idxs for idxs in buckets.values() if len(idxs) > 1]

def tiny_offsets(index, iteration, t, j):
    # small deterministic nudge per element
    base_amp = t * max(0.0, min(1.0, float(j))) * 0.99
    amp = base_amp * (1.0 + 0.25 * iteration)
    a = ((index *  37 + 7) % 11 + 1) / 11.0
    b = ((index * 113 + 5) % 13 + 1) / 13.0
    c = ((index * 251 + 3) % 17 + 1) / 17.0
    return (a * amp, b * amp, c * amp)

# ---------- main: resolve duplicates ----------
iteration = 0
Duplicates = find_duplicates()

while Duplicates and iteration < max_iters:
    for group in Duplicates:
        # keep the first as anchor; nudge the rest
        for rank, idx in enumerate(group[1:], start=1):
            dL, dW, dH = tiny_offsets(idx + rank, iteration, tol, jitter)
            L[idx] += dL
            W[idx] += dW
            H[idx] += dH
    iteration += 1
    Duplicates = find_duplicates()

# ---------- make Duplicates readable for panel ----------
# (now Duplicates is a list-of-lists of indices)
Duplicates = [list(map(int, grp)) for grp in Duplicates]  # safe now

if len(Duplicates) > 0:
    dup_lines = ["  " + ", ".join(map(str, grp)) for grp in Duplicates]
    dup_text = "Duplicate groups (by index):\n" + "\n".join(dup_lines)
else:
    dup_text = "No duplicates."

# ---------- outputs ----------
AllUnique = (len(Duplicates) == 0)
L_out, W_out, H_out = L, W, H

if n == 0:
    Report = "No beams to check."
elif AllUnique:
    Report = "✅ All beams are unique (n={}), resolved in {} iteration(s) at tol={:.3g}.".format(n, iteration, tol)
else:
    Report = "⚠ Still duplicates after {} iteration(s) at tol={:.3g}.\n{}".format(iteration, tol, dup_text)
# ---------- end make_unique ----------
report = Panel(make_unique.Report)
scale_2 = Scale(Geometry=section_deconstruct.Surfaces, Center=Point(0, 0, 0), Factor="1000")  # -> Geometry, Transform
curve = Curve(scale_2.Geometry)
simplify_curve = SimplifyCurve(Curve=curve, Tolerance="10", AngleTolerance="10")  # -> Curve, Simplified
control_points = ControlPoints(Curve=simplify_curve.Curve)  # -> Points, Weights, Knots
polyline = PolyLine(Vertices=control_points.Points, Closed=True)  # -> flatten(Polyline)
rotate = Rotate(Geometry=scale_2.Geometry, Angle=degrees("90"), Plane=PlaneXY(0, 0, 0))  # -> Geometry, Transform
division = Division(A=make_unique.H_out, B=2)
division_2 = Division(A=make_unique.W_out, B=2)
negative_2 = Negative(Value=division)
negative_3 = Negative(Value=division_2)

# ----
# Check max and min sizes
find_max_min = Python3Script(tall_in=make_unique.W_out)  # -> out; inputs tall_in: list
# ---------- find_max_min: Python ----------
def finn_max_og_min(talliste):
    if not talliste:
        return None, None  # håndterer tom liste

    maksimum = max(talliste)
    minimum = min(talliste)
    return maksimum, minimum


# Eksempelbruk:
maks, min_ = finn_max_og_min(tall_in)

print(f"Største tall: {maks}")
print(f"Minste tall: {min_}")
# ---------- end find_max_min ----------
find_max_min_2 = Python3Script(tall_in=make_unique.H_out)  # -> out; inputs tall_in: list; same code as find_max_min
find_max_min_3 = Python3Script(tall_in=make_unique.L_out)  # -> out; inputs tall_in: list; same code as find_max_min
w_out = Panel(find_max_min)
h_out = Panel(find_max_min_2)
l_out = Panel(find_max_min_3)

construct_domain_3 = ConstructDomain(DomainStart=division_2, DomainEnd=negative_3)
construct_domain_4 = ConstructDomain(DomainStart=division, DomainEnd=negative_2)
pick_profiles = Python3Script(S=rotate.Geometry, N=number_slider_2, Seed="3")  # -> out, R, I; inputs S: list, N: Int32, Seed: Int32
# ---------- pick_profiles: Python ----------
import random

# S : liste med surfaces
# N : ønsket antall
# Seed : valgfri, heltall for å styre random (kan være None)

# Sikring mot rare input
if S is None:
    S = []
if N is None:
    N = 0

count = len(S)

# Sett seed hvis den er gitt
try:
    if Seed is not None:
        random.seed(Seed)
    else:
        random.seed()  # mer "tilfeldig"
except:
    random.seed()

I = []
R = []

if count == 0 or N <= 0:
    # tom input eller ikke ønsket noe
    R = []
    I = []
else:
    if N <= count:
        # Færre eller likt -> velg uten duplikater
        I = random.sample(range(count), N)
    else:
        # Flere enn i lista -> velg med duplikater (med tilbakelegging)
        I = [random.randrange(count) for _ in range(N)]
    
    # Lag resultatlista
    R = [S[i] for i in I]
# ---------- end pick_profiles ----------
unit_z = UnitZ(Factor=make_unique.L_out)
antall_søyler = Number(number_slider_2)

# ----
# Scale and move to origo
rectangle = Rectangle(Plane=point, XSize=construct_domain_3, YSize=construct_domain_4, Radius=0)  # -> Rectangle, Length
extrude = Extrude(Base=rectangle.Rectangle, Direction=unit_z)
cap_holes = CapHoles(Brep=extrude)  # -> flatten(Brep)
centerplacing = Python3Script(B=cap_holes, s=scale)  # -> out, B_moved, T; inputs B: list of Brep, s: Double
# ---------- centerplacing: Python ----------
import Rhino.Geometry as rg

B_moved = []
T = []   # translasjonene (til origo)

for b in B:
    if not b:
        B_moved.append(None)
        T.append(None)
        continue

    # Finn senter (volumsenter)
    vmp = rg.VolumeMassProperties.Compute(b)
    if vmp:
        c = vmp.Centroid
    else:
        # fallback: bounding box-senter
        c = b.GetBoundingBox(True).Center

    # 1) Translasjonsvektor til origo
    vec = rg.Vector3d(-c.X, -c.Y, -c.Z)
    xform_move = rg.Transform.Translation(vec)
    b.Transform(xform_move)

    # 2) Skalering i Z-retning rundt origo
    # s = 1.0 -> ingen skalering
    if s is not None and s != 1.0:
        # Skaler i global Z, rundt (0,0,0)
        xform_scale = rg.Transform.Scale(rg.Plane.WorldXY, 1.0, 1.0, s)
        b.Transform(xform_scale)

    B_moved.append(b)
    T.append(vec)
# ---------- end centerplacing ----------
panel_12 = Panel(centerplacing.B_moved)
make_names = Python3Script(N=antall_søyler, prefix=filename, digits="4")  # -> out, simplify(graft(Names)); inputs N: Int32, prefix: String, digits: Int32
# ---------- make_names: Python ----------
# Inputs: N (int), prefix (str), digits (int)
if N is None: N = 0
if prefix is None: prefix = "Beam_"
if digits is None or digits < 1: digits = 3

fmt = "{{:0{}d}}".format(digits)
Names = [prefix + fmt.format(i+1) for i in range(N)]
# ---------- end make_names ----------

fem_design_profiles = Data(pick_profiles.R)
unit_z_2 = UnitZ(Factor=1)
bounding_box = BoundingBox(Content=centerplacing.B_moved, Plane=PlaneXY(0, 0, 0))  # -> Box, Box_2
line_sdl = LineSDL(Start="0,0,-9999", Direction=unit_z_2, Length="100000")
brep_line = BrepLine(Brep=bounding_box.Box, Line=line_sdl, LimitToFirst=False)  # -> Curves, Points
polyline_2 = PolyLine(Vertices=brep_line.Points, Closed=False)
line = Line(polyline_2)
end_points = EndPoints(Curve=flatten(line))  # -> Start, End
bot = Point(end_points.Start)
top = Point(end_points.End)
line_2 = Line(StartPoint=end_points.Start, EndPoint=end_points.End)
curve_middle = CurveMiddle(Curve=line_2)
number = Number(rotasjon_om_1_akse_0_hvis_vi_ikke_skal_r)
round_point_cluster = RoundPointCLUSTER(point=curve_middle)
construct_domain_5 = ConstructDomain(DomainStart="0", DomainEnd=number)
unit_x = UnitX(Factor=1)
unit_y = UnitY(Factor=1)
unit_z_3 = UnitZ(Factor=1)
# Rotate solid, axis and top and bottom point
random_4 = Random(Range=construct_domain_5, Number=antall_søyler, Seed=2)
rotate_3d_solids = Rotate3D(Geometry=centerplacing.B_moved, Angle=degrees(random_4), Center=round_point_cluster, Axis=unit_x)  # -> Geometry, Transform
rotate_3d_bottom_point = Rotate3D(Geometry=bot, Angle=degrees(random_4), Center=round_point_cluster, Axis=unit_x)  # -> Geometry, Transform
rotate_3d_top_point = Rotate3D(Geometry=top, Angle=degrees(random_4), Center=round_point_cluster, Axis=unit_x)  # -> Geometry, Transform
axis_curve = Rotate3D(Geometry=line_2, Angle=degrees(random_4), Center=round_point_cluster, Axis=unit_x)  # -> Geometry, Transform
number_2 = Number(rotasjon_om_2_akse_0_hvis_vi_ikke_skal_r)
unit_x_2 = UnitX(Factor=1)
construct_domain_6 = ConstructDomain(DomainStart="0", DomainEnd=number_2)
unit_y_2 = UnitY(Factor=1)
unit_z_4 = UnitZ(Factor=1)
random_5 = Random(Range=construct_domain_6, Number=antall_søyler, Seed=7)
rotate_3d_solids_2 = Rotate3D(Geometry=rotate_3d_solids.Geometry, Angle=degrees(random_5), Center=round_point_cluster, Axis=unit_y_2)  # -> Geometry, Transform
rotate_3d_bottom_point_2 = Rotate3D(Geometry=rotate_3d_bottom_point.Geometry, Angle=degrees(random_5), Center=round_point_cluster, Axis=unit_y_2)  # -> Geometry, Transform
rotate_3d_top_point_2 = Rotate3D(Geometry=rotate_3d_top_point.Geometry, Angle=degrees(random_5), Center=round_point_cluster, Axis=unit_y_2)  # -> Geometry, Transform
axis_curve_2 = Rotate3D(Geometry=axis_curve.Geometry, Angle=degrees(random_5), Center=round_point_cluster, Axis=unit_y_2)  # -> Geometry, Transform
number_3 = Number(rotasjon_om_3_akse_0_hvis_vi_ikke_skal_r)
unit_x_3 = UnitX(Factor=1)
construct_domain_7 = ConstructDomain(DomainStart="0", DomainEnd=number_3)
unit_y_3 = UnitY(Factor=1)
unit_z_5 = UnitZ(Factor=1)
random_6 = Random(Range=construct_domain_7, Number=antall_søyler, Seed=5)
rotate_3d_solids_3 = Rotate3D(Geometry=rotate_3d_solids_2.Geometry, Angle=degrees(random_6), Center=round_point_cluster, Axis=unit_z_5)  # -> Geometry, Transform
rotate_3d_bottom_point_3 = Rotate3D(Geometry=rotate_3d_bottom_point_2.Geometry, Angle=degrees(random_6), Center=round_point_cluster, Axis=unit_z_5)  # -> Geometry, Transform
rotate_3d_top_point_3 = Rotate3D(Geometry=rotate_3d_top_point_2.Geometry, Angle=degrees(random_6), Center=round_point_cluster, Axis=unit_z_5)  # -> Geometry, Transform
axis_curve_3 = Rotate3D(Geometry=axis_curve_2.Geometry, Angle=degrees(random_6), Center=round_point_cluster, Axis=unit_z_5)  # -> Geometry, Transform

# ----
# Definding point C, with a little variation from the middle
panel_13 = Panel("0.4")
construct_domain_8 = ConstructDomain(DomainStart=panel_13, DomainEnd="0.6")
random_7 = Random(Range=construct_domain_8, Number=antall_søyler, Seed=2)
evaluate_curve = EvaluateCurve(Curve=axis_curve_3.Geometry, Parameter=random_7)  # -> Point, Tangent, Angle

# ----
# Calculate unitvektor
vector_2pt = Vector2Pt(PointA=rotate_3d_top_point_3.Geometry, PointB=rotate_3d_bottom_point_3.Geometry, Unitize=False)  # -> Vector, Length
panel_14 = Panel(vector_2pt.Vector)
unit_vector = UnitVector(Vector=vector_2pt.Vector)

panel_15 = Panel(evaluate_curve.Point)

# ----
# Make pointcloud
mesh_brep = MeshBrep(
    Brep=rotate_3d_solids_3.Geometry,
    Settings={GridMaxCount=0, GridMinCount=16, JaggedSeams=False, MaxEdgeLength=0, MinEdgeLength=0.0001, MinTolerance=0, Refine=True, RefineAngle=0, RelativeTolerance=0.65, SimplePlanes=True, Tolerance=0})
triangulate = Triangulate(Mesh=mesh_brep)  # -> Mesh, Count
pointcloud_trimesh = CSharpScript(ms=flatten(triangulate.Mesh), nr_pts=multiplication)  # -> out, pts_faces, PointC, Tot_area; inputs ms: list of Mesh, nr_pts: Int32
# ---------- pointcloud_trimesh: C# ----------
// Grasshopper Script Instance
#region Usings
using System;
using System.Linq;
using System.Collections;
using System.Collections.Generic;
using System.Drawing;

using Rhino;
using Rhino.Geometry;

using Grasshopper;
using Grasshopper.Kernel;
using Grasshopper.Kernel.Data;
using Grasshopper.Kernel.Types;
#endregion

public class Script_Instance : GH_ScriptInstance
{
    #region Notes
    /* 
      Members:
        RhinoDoc RhinoDocument
        GH_Document GrasshopperDocument
        IGH_Component Component
        int Iteration

      Methods (Virtual & overridable):
        Print(string text)
        Print(string format, params object[] args)
        Reflect(object obj)
        Reflect(object obj, string method_name)
    */
    #endregion

    private void RunScript(
		List<Mesh> ms,
		int nr_pts,
		ref object pts_faces,
		ref object PointC,
		ref object Tot_area)
    {
        // Write your logic here
        // area for each meshface
        var vs = new List<double>();
        var rs = new List<int>();
        var pcs = new List<PointCloud>();
        //total area for each mesh
        var areas = new List<double>();
        var rand = new Random();
        foreach(Mesh m in ms)
        {
            var pc = new PointCloud();
            double areaM = AreaMassProperties.Compute(m).Area;
            areas.Add(areaM);
            var listRes = new List<int>();
            foreach(MeshFace mf in m.Faces)
            {
                var A = m.Vertices[mf.A];
                var B = m.Vertices[mf.B];
                var C = m.Vertices[mf.C];
                    // Convert Point3f → Vector3d for math operations
                    // Calculate vectro to calculate crossproduct/area of meshface
                Vector3d AB = new Vector3d(B.X - A.X, B.Y - A.Y, B.Z - A.Z);
                Vector3d AC = new Vector3d(C.X - A.X, C.Y - A.Y, C.Z - A.Z);

                // Area = 0.5 * |AB × AC|
                Vector3d cross = Vector3d.CrossProduct(AB, AC);
                double area = 0.5 * cross.Length;
                //calculate size of mesh, compared to full mesh
                double ares = area/areaM*nr_pts;
                vs.Add(ares);
                int res = Convert.ToInt32(Math.Round(ares));
                listRes.Add(res);
                
            }

         //function which change listRes in to correct list of resolutions
         // Juster listRes slik at sum(listRes) == nr_pts
            AdjustCounts(listRes, nr_pts, rand);

            int i=0;
            foreach(MeshFace mf in m.Faces)
            {
                var A = m.Vertices[mf.A];
                var B = m.Vertices[mf.B];
                var C = m.Vertices[mf.C];
                int nres = listRes[i];
                rs.Add(nres);
                var rpts = RandomPointsOnTriangle(A, B, C, nres, rand);
                pc.AddRange(rpts);
                i++;
            }
            pcs.Add(pc);
        }

            

        pts_faces = rs;
        PointC = pcs;
        Tot_area = areas;
    }
// --- HJELPEFUNKSJON: juster liste med counts til å få riktig total ---
    // counts: antall punkter per face (endres in-place)
    // target: ønsket total sum (nr_pts)
    static void AdjustCounts(List<int> counts, int target, Random rand)
    {
        if (counts == null || counts.Count == 0)
            return;

        if (target < 0)
            target = 0;

        int total = 0;
        for (int i = 0; i < counts.Count; i++)
            total += counts[i];

        if (total == target)
            return;

        // For få punkter: fyll opp, start på facene med færrest punkter
        // For få punkter: fyll opp, alltid på faces som *nå* har minst
        if (total < target)
        {
            int deficit = target - total;

            while (deficit > 0)
            {
                // finn minste antall punkter noen face har
                int minCount = int.MaxValue;
                for (int i = 0; i < counts.Count; i++)
                    if (counts[i] < minCount)
                        minCount = counts[i];

                // lag liste over alle faces som har minCount
                var candidates = new List<int>();
                for (int i = 0; i < counts.Count; i++)
                    if (counts[i] == minCount)
                        candidates.Add(i);

                if (candidates.Count == 0)
                    break;

                // velg én av disse tilfeldig (eller ta første hvis du ikke vil ha randomness)
                int chosenIndex = candidates[rand.Next(candidates.Count)];
                counts[chosenIndex]++;

                deficit--;
            }
        }

        // For mange punkter: fjern, start på facene med flest punkter, fjern random blant "toppen"
        else // total > target
        {
            int excess = total - target;

            while (excess > 0)
            {
                // finn maks antall punkter noen face har
                int maxCount = 0;
                for (int i = 0; i < counts.Count; i++)
                    if (counts[i] > maxCount)
                        maxCount = counts[i];

                if (maxCount <= 0)
                    break; // ingenting mer å fjerne

                // lag liste over alle faces som har maxCount
                var candidates = new List<int>();
                for (int i = 0; i < counts.Count; i++)
                    if (counts[i] == maxCount)
                        candidates.Add(i);

                if (candidates.Count == 0)
                    break;

                // velg én av disse randomly
                int chosenIndex = candidates[rand.Next(candidates.Count)];
                counts[chosenIndex]--;
                excess--;
            }
        }
    }

    // --- Random punkter i trekant, bruker samme Random som resten ---
    public static List<Point3d> RandomPointsOnTriangle(Point3f A, Point3f B, Point3f C, int count, Random rand)
    {
        var pts = new List<Point3d>(count);

        for (int i = 0; i < count; i++)
        {
            double r1 = rand.NextDouble();
            double r2 = rand.NextDouble();

            double sqrtR1 = Math.Sqrt(r1);
            double u = 1.0 - sqrtR1;
            double v = sqrtR1 * (1.0 - r2);
            double w = sqrtR1 * r2;

            double x = (u * A.X + v * B.X + w * C.X);
            double y = (u * A.Y + v * B.Y + w * C.Y);
            double z = (u * A.Z + v * B.Z + w * C.Z);

            pts.Add(new Point3d(x, y, z));
        }

        return pts;
    }
}
# ---------- end pointcloud_trimesh ----------
panel_16 = Panel(pointcloud_trimesh.PointC)

predict_end_points_new = PredictEndPoints_NEW(Points=<missing>, ModelPath=<missing>, ScriptPath=<missing>, Run=<missing>)  # -> Top, Bottom, C, flatten(Direction), T1, T2; disabled

# ----
# Remember to connect the Beam_ID
beam_id = Text(make_names.Names)
panel_17 = Panel(beam_id)

nr_of_pts = Python3Script(PC=pointcloud_trimesh.PointC)  # -> out, b; inputs PC: PointCloud
# ---------- nr_of_pts: Python ----------
b=PC.Count
# ---------- end nr_of_pts ----------
unit_vektor_u = Vector(simplify(graft(unit_vector)))
panel_18 = Panel(unit_vektor_u)
c_points = Point(simplify(graft(evaluate_curve.Point)))

# ----
# Random shuffle points i cloud
panel_19 = Panel("42")
random_shuffle_points = Python3Script(PCs=pointcloud_trimesh.PointC, Seed=panel_19)  # -> out, simplify(graft(PCs_shuffled)); inputs PCs: list of PointCloud, Seed: Int32
# ---------- random_shuffle_points: Python ----------
import Rhino
import random

def shuffle_pointcloud(pc, rng):
    """
    Tar inn en Rhino.Geometry.PointCloud og returnerer en ny
    PointCloud der rekkefølgen på punktene er randomisert.
    """
    count = pc.Count
    if count == 0:
        return pc  # bare returner tom sky

    # Lag permuterte indekser
    indices = list(range(count))
    rng.shuffle(indices)

    has_normals = pc.ContainsNormals
    has_colors = pc.ContainsColors

    new_pc = Rhino.Geometry.PointCloud()

    for i in indices:
        item = pc[i]              # PointCloudItem
        loc = item.Location

        # Legg til punktet først
        new_index = new_pc.Add(loc)

        # Kopier normal hvis pointclouden har normaldata
        if has_normals:
            new_pc[new_index].Normal = item.Normal

        # Kopier farge hvis pointclouden har fargedata
        if has_colors:
            new_pc[new_index].Color = item.Color

    return new_pc


# ---------- HOVEDDEL ----------

# Sørg for at vi har en liste
try:
    pcs_list = list(PCs)
except:
    pcs_list = [PCs]

# RNG for reproduserbarhet
if Seed is None:
    rng = random.Random()
else:
    rng = random.Random(Seed)

PCs_shuffled = [shuffle_pointcloud(pc, rng) for pc in pcs_list]
# ---------- end random_shuffle_points ----------

panel_20 = Panel(random_shuffle_points.PCs_shuffled)

# ----
# Beregne t1 og t2 og kontrollere dem.
# Definisjoner for t1 og t2: Bjelkegeometri – formler (p1 på +u-siden)
# 
# Gitt endepunktene p1 og p2 på en bjelke, og et punkt c langs bjelken:
# 
# Enhetsvektor langs bjelken:
# u = (p1 – p2) / |p1 – p2|
# eller (p2 → p1 retning)
# 
# Parametrisering av endepunkter:
# p1 = c + t1·u
# p2 = c – t2·u
# 
# Her er t1 og t2 skalarer (tall) som sier hvor langt fra c til hvert endepunkt langs retningen u.
# 
# Beregning av t1 og t2:
# t1 = (p1 – c) · u
# t2 = (c – p2) · u
# 
# Dot-produktet gir avstand langs u.
# Siden u er en enhetsvektor (|u| = 1), er u·u = 1,
# derfor trengs ingen nevner.
# 
# Kortversjon:
# u = (p1–p2)/|p1–p2|
# t1 = (p1–c)·u
# t2 = (c–p2)·u
# p1 = c + t1·u
# p2 = c – t2·u
vector_2pt_2 = Vector2Pt(PointA=rotate_3d_bottom_point_3.Geometry, PointB=evaluate_curve.Point, Unitize=False)  # -> Vector, Length
vector_2pt_3 = Vector2Pt(PointA=evaluate_curve.Point, PointB=rotate_3d_top_point_3.Geometry, Unitize=False)  # -> Vector, Length
t2 = Multiplication(P2C=vector_2pt_2.Vector, B=unit_vector)
t1 = Multiplication(CP1=vector_2pt_3.Vector, B=unit_vector)
t1_2 = Panel(t1)
t2_2 = Panel(t2)

multiplication_2 = Multiplication(A=t2, B="-1")
amplitude = Amplitude(Vector=unit_vector, Amplitude=multiplication_2)
panel_21 = Panel("p2 = c - t2*u")
move = Move(Geometry=evaluate_curve.Point, Motion=amplitude)  # -> Geometry, Transform

amplitude_2 = Amplitude(Vector=unit_vector, Amplitude=t1)
move_2 = Move(Geometry=evaluate_curve.Point, Motion=amplitude_2)  # -> Geometry, Transform
panel_22 = Panel("p1 = c + t1*u")

distance = Distance(PointA=rotate_3d_top_point_3.Geometry, PointB=move_2.Geometry)
distance_2 = Distance(PointA=rotate_3d_bottom_point_3.Geometry, PointB=move.Geometry)
panel_23 = Panel(distance)
panel_24 = Panel(distance_2)

t2_3 = Number(simplify(graft(t2)))
t1_3 = Number(simplify(graft(t1)))
panel_25 = Panel(t2_3)
panel_26 = Panel(t1_3)
entwine = Entwine(
    Branch0X=beam_id,
    Branch1X=c_points,
    Branch2X=unit_vektor_u,
    Branch3X=t1_3,
    Branch4X=t2_3,
    Branch5X=random_shuffle_points.PCs_shuffled,
    FlattenInputs=False)
panel_27 = Panel(entwine)

# ----
# Write to JSON
list_item = ListItem(List=flatten(beam_id), Index=-1, Wrap=True)

text_join = TextJoin(Text=[list_item, multiplication], Join="_P.")

panel_28 = Panel(text_join)
c_script = CSharpScript(Data_in=flatten(entwine), Folder="C:\Save_JSON", FileName=panel_28, Run=Toggle(False))  # -> out, A; inputs Data_in: list, Folder: String, FileName: String, Run: Boolean
# ---------- c_script: C# ----------
// Grasshopper Script Instance
#region Usings
using System;
using System.Linq;
using System.Collections;
using System.Collections.Generic;
using System.Drawing;
using System.Globalization;
using System.IO;
using System.Text;

using Rhino;
using Rhino.Geometry;

using Grasshopper;
using Grasshopper.Kernel;
using Grasshopper.Kernel.Data;
using Grasshopper.Kernel.Types;
#endregion

public class Script_Instance : GH_ScriptInstance
{
    #region Notes
    /* 
      Members:
        RhinoDoc RhinoDocument
        GH_Document GrasshopperDocument
        IGH_Component Component
        int Iteration

      Methods (Virtual & overridable):
        Print(string text)
        Print(string format, params object[] args)
        Reflect(object obj)
        Reflect(object obj, string method_name)
    */
    #endregion

    // Inputs:  Data_in (List<object>), Folder (string), FileName (string), Run (bool)
    // Output:  A (object/string)
    private void RunScript(
		List<object> Data_in,
		string Folder,
		string FileName,
		bool Run,
		ref object A)
    {
        if (!Run)
        {
            A = "Run = false, no file written.";
            return;
        }

        if (Data_in == null || Data_in.Count == 0)
        {
            A = "Data_in is empty.";
            return;
        }

        int total = Data_in.Count;

        // Vi forventer 6 blokker: id, c, v, t1, t2, cloud
        if (total % 6 != 0)
        {
            A = string.Format("Data_in count ({0}) is not divisible by 6.", total);
            return;
        }

        int nBeams = total / 6;

        // Valider Folder
        if (string.IsNullOrWhiteSpace(Folder))
        {
            A = "Folder is empty.";
            return;
        }

        if (!Directory.Exists(Folder))
            Directory.CreateDirectory(Folder);

        // Default filnavn hvis tomt
        if (string.IsNullOrWhiteSpace(FileName))
            FileName = "beams";

        // Lag første foreslåtte sti
        string baseName = FileName;
        string path = Path.Combine(Folder, baseName + ".json");

        // Sjekk om fila allerede finnes → legg på _01, _02, _03, ...
        int counter = 1;
        while (File.Exists(path))
        {
            string suffix = "_" + counter.ToString("D2"); // gir _01, _02, _03 ...
            path = Path.Combine(Folder, baseName + suffix + ".json");
            counter++;
        }

        var ci = CultureInfo.InvariantCulture;

        // ---- AVRUNNING: juster antall desimaler her ----
        int DECIMALS = 6;                           // <--- endre dette tallet hvis du vil
        string numFmt = "F" + DECIMALS.ToString();  // brukes for alle koordinater og t1/t2
        // -----------------------------------------------

        var sb = new StringBuilder();

        // ---- HEADER ----
        sb.AppendLine("{");
        sb.AppendLine("  \"export_info\": {");
        sb.AppendLine("    \"source\": \"Grasshopper\",");
        sb.AppendLine("    \"version\": \"1.0\",");
        sb.AppendLine("    \"units\": \"m\",");
        sb.AppendFormat("    \"exported_at\": \"{0}\"\n",
            DateTime.UtcNow.ToString("yyyy-MM-dd'T'HH:mm:ss'Z'", ci));
        sb.AppendLine("  },");
        sb.AppendLine("  \"beams\": [");

        // ---- BEAMS ----
        for (int i = 0; i < nBeams; i++)
        {
            // Segmenter i Data_in:
            // 0 .. nBeams-1            -> id
            // nBeams .. 2*nBeams-1     -> c (Point3d)
            // 2*nBeams .. 3*nBeams-1   -> v (Vector3d)
            // 3*nBeams .. 4*nBeams-1   -> t1 (double/float)
            // 4*nBeams .. 5*nBeams-1   -> t2 (double/float)
            // 5*nBeams .. 6*nBeams-1   -> cloud

            object idObj     = Data_in[i];
            object cObj      = Data_in[i + nBeams];
            object vObj      = Data_in[i + 2 * nBeams];
            object t1Obj     = Data_in[i + 3 * nBeams];
            object t2Obj     = Data_in[i + 4 * nBeams];
            object cloudObj  = Data_in[i + 5 * nBeams];

            string id = idObj != null ? idObj.ToString() : "";

            // c som Point3d
            Point3d c = Point3d.Unset;
            if (cObj is Point3d)
                c = (Point3d) cObj;

            // v som Vector3d
            Vector3d v = Vector3d.Unset;
            if (vObj is Vector3d)
                v = (Vector3d) vObj;

            // t1 og t2 som double
            double t1 = 0.0;
            if (t1Obj is double)
                t1 = (double) t1Obj;
            else if (t1Obj is float)
                t1 = (double) (float) t1Obj;
            else if (t1Obj is int)
                t1 = (double) (int) t1Obj;

            double t2 = 0.0;
            if (t2Obj is double)
                t2 = (double) t2Obj;
            else if (t2Obj is float)
                t2 = (double) (float) t2Obj;
            else if (t2Obj is int)
                t2 = (double) (int) t2Obj;

            // Cloud -> samling av Point3d
            int pointCount = 0;
            IList<Point3d> pts = null;

            PointCloud pc = cloudObj as PointCloud;
            if (pc != null)
            {
                var list = new List<Point3d>(pc.Count);
                for (int k = 0; k < pc.Count; k++)
                    list.Add(pc[k].Location);
                pts = list;
                pointCount = pc.Count; // bruk faktisk antall
            }
            else if (cloudObj is IList<Point3d>)
            {
                pts = (IList<Point3d>) cloudObj;
                pointCount = pts.Count;
            }
            else
            {
                pts = new List<Point3d>();
            }

            sb.AppendLine("    {");
            sb.AppendFormat("      \"id\": \"{0}\",\n", id);

            // c
            sb.AppendLine("      \"c\": [");
            sb.AppendFormat("        {0},\n        {1},\n        {2}\n",
                c.X.ToString(numFmt, ci), c.Y.ToString(numFmt, ci), c.Z.ToString(numFmt, ci));
            sb.AppendLine("      ],");

            // v
            sb.AppendLine("      \"v\": [");
            sb.AppendFormat("        {0},\n        {1},\n        {2}\n",
                v.X.ToString(numFmt, ci), v.Y.ToString(numFmt, ci), v.Z.ToString(numFmt, ci));
            sb.AppendLine("      ],");

            // t1 og t2
            sb.AppendFormat("      \"t1\": {0},\n", t1.ToString(numFmt, ci));
            sb.AppendFormat("      \"t2\": {0},\n", t2.ToString(numFmt, ci));

            // point_count (heltall, ingen desimaler)
            sb.AppendFormat("      \"point_count\": {0},\n", pointCount);

            // cloud
            sb.AppendLine("      \"cloud\": [");

            if (pts != null && pts.Count > 0)
            {
                for (int j = 0; j < pts.Count; j++)
                {
                    Point3d p = pts[j];
                    sb.AppendLine("        [");
                    sb.AppendFormat("          {0},\n          {1},\n          {2}\n",
                        p.X.ToString(numFmt, ci), p.Y.ToString(numFmt, ci), p.Z.ToString(numFmt, ci));
                    sb.Append("        ]");
                    if (j < pts.Count - 1)
                        sb.Append(",");
                    sb.AppendLine();
                }
            }

            sb.AppendLine("      ]");

            sb.Append("    }");
            if (i < nBeams - 1)
                sb.Append(",");
            sb.AppendLine();
        }

        sb.AppendLine("  ]");
        sb.AppendLine("}");

        // Skriv fil
        File.WriteAllText(path, sb.ToString(), Encoding.UTF8);

        A = path;
    }
}
# ---------- end c_script ----------
panel_29 = Panel(c_script.A)

# ==== cluster RoundPointCLUSTER
point = ClusterInput()
deconstruct = Deconstruct(Point=point)  # -> XComponent, YComponent, ZComponent
round = Round(Number=deconstruct.XComponent)  # -> Nearest, Floor, Ceiling
round_2 = Round(Number=deconstruct.YComponent)  # -> Nearest, Floor, Ceiling
round_3 = Round(Number=deconstruct.ZComponent)  # -> Nearest, Floor, Ceiling
construct_point = ConstructPoint(XCoordinate=round.Nearest, YCoordinate=round_2.Nearest, ZCoordinate=round_3.Nearest)
point_2 = ClusterOutput(construct_point)
